# Grasshopper definition GrasshopperTests.gh (Grasshopper 1.0.7)
# plug-ins: Pterodactyl, Brontosaurus, Megarachne

number_slider = Slider(10, range=0..10)  # disabled
number_slider_2 = Slider(5, range=0..10)  # disabled
number_slider_3 = Slider(5, range=0..10)  # disabled
toggle = BooleanToggle(True)  # disabled
pt = ConstructPoint(XCoordinate=0, YCoordinate=0, ZCoordinate=0)  # disabled
pt_2 = ConstructPoint(XCoordinate=number_slider, YCoordinate=0, ZCoordinate=0)  # disabled
pt_3 = ConstructPoint(XCoordinate=0, YCoordinate=0, ZCoordinate=0)  # disabled
pt_4 = ConstructPoint(XCoordinate=number_slider_2, YCoordinate=number_slider_3, ZCoordinate=0)  # disabled
two_points_to_graph_part = TwoPointsToGraphPart(PointA=pt_3, PointB=pt_4, IsDirected=toggle)  # disabled
two_points_to_graph_part_2 = TwoPointsToGraphPart(PointA=pt_2, PointB=pt_4, IsDirected=toggle)  # disabled
two_points_to_graph_part_3 = TwoPointsToGraphPart(PointA=pt, PointB=pt_2, IsDirected=toggle)  # disabled
# Visualization
create_graph = CreateGraph(GraphParts=[two_points_to_graph_part_3, two_points_to_graph_part, two_points_to_graph_part_2], Tolerance=0.0001)  # disabled
deconstruct_graph = DeconstructGraph(Graph=create_graph)  # -> GraphArray, Vertices, Edges, AdjacencyList; disabled
panel = Panel("0.5")  # disabled
lng = ListLength(List=deconstruct_graph.Vertices)  # disabled
panel_2 = Panel("0")  # disabled
panel_3 = Panel("1")  # disabled
crv = Curve(deconstruct_graph.Edges)  # disabled
linedim = LineDimension(Line=deconstruct_graph.Edges, Text="{0:0.00}", Size=panel)  # disabled
series = Series(Start=panel_2, Step=panel_3, Count=lng)  # disabled
tag = TextTag3D(Location=deconstruct_graph.Vertices, Text=series, Size=1, Justification=7)  # disabled
calendar = Calendar()

# ----
# Vector To Graph Part
number_slider_4 = Slider(5, range=0..10)
panel_4 = Panel("VectorToGraphPartMilimeters_VectorTrue_DeconstructIsDirected")
pt_5 = ConstructPoint(XCoordinate=Slider(4, range=0..10), YCoordinate=number_slider_4, ZCoordinate=0)
vec = VectorXYZ(XComponent=Slider(2, range=0..10), YComponent=Slider(3, range=0..10), ZComponent=0)  # -> Vector, Length
pt_6 = ConstructPoint(XCoordinate=Slider(4, range=0..10), YCoordinate=Slider(5, range=0..10), ZCoordinate=0)
vec_2 = VectorXYZ(XComponent=Slider(2, range=0..10), YComponent=Slider(3, range=0..10), ZComponent=0)  # -> Vector, Length
vector_to_graph_part = VectorToGraphPart(Vector=vec.Vector, Point=pt_5, IsDirected=Toggle(True))
vector_to_graph_part_2 = VectorToGraphPart(Vector=vec_2.Vector, Point=pt_6, IsDirected=Toggle(True))
deconstruct_graph_part = DeconstructGraphPart(GraphPart=vector_to_graph_part)  # -> Vertices, Edge, IsDirected, Weight
txt = Text("""Graph Part
Is Directed: True
Edge Weight: 3.60555127546399""")
divide = DivideCurve(Curve=deconstruct_graph_part.Edge, Count=10, Kinks=False)  # -> Points, Tangents, Parameters
pt_7 = Point([Point(4, 5, 0), Point(6, 8, 0)])
assert = Assert(TestNames="VectorToGraphPartMilimeters_VectorTrue_String", Expected=txt, Actual=vector_to_graph_part_2)  # -> Result, FailedInfo
bool = Boolean(True)
num = Number(3.605551275)
pt_8 = Point([Point(4, 5, 0), Point(4.2, 5.3, 0), Point(4.4, 5.6, 0), Point(4.6, 5.9, 0), Point(4.8, 6.2, 0), Point(5, 6.5, 0), Point(5.2, 6.8, 0), Point(5.4, 7.1, 0), Point(5.6, 7.4, 0), Point(5.8, 7.7, 0), Point(6, 8, 0)])
assert_point_list = AssertPointList(
    TestName="VectorToGraphPartMilimeters_VectorTrue_DeconstructVertices",
    ExpectedPointList=pt_7,
    ActualPointList=deconstruct_graph_part.Vertices,
    Tolerance="0.0001")  # -> Result, FailedInfo
assert_2 = Assert(TestNames=panel_4, Expected=bool, Actual=deconstruct_graph_part.IsDirected)  # -> Result, FailedInfo
assert_3 = Assert(TestNames="VectorToGraphPartMilimeters_VectorTrue_DeconstructWeight", Expected=num, Actual=deconstruct_graph_part.Weight)  # -> Result, FailedInfo
assert_point_list_2 = AssertPointList(
    TestName="VectorToGraphPartMilimeters_VectorTrue_DeconstructEdges",
    ExpectedPointList=pt_8,
    ActualPointList=divide.Points,
    Tolerance="0.0001")  # -> Result, FailedInfo
entwine = Entwine(
    Branch00=assert.Result,
    Branch01=assert_point_list.Result,
    Branch02=assert_point_list_2.Result,
    Branch03=assert_2.Result,
    Branch04=assert_3.Result,
    FlattenInputs=True)  # -> flatten(Result)

# ----
# Two Points To Graph Part
number_slider_5 = Slider(3, range=0..10)
panel_5 = Panel("TwoPointsToGraphPartMilimeters_TwoPointsTrue_DeconstructVertices")
panel_6 = Panel("TwoPointsToGraphPartMilimeters_TwoPointsTrue_DeconstructIsDirected")
panel_7 = Panel("TwoPointsToGraphPartMilimeters_TwoPointsTrue_DeconstructEdges")
pt_9 = ConstructPoint(XCoordinate=Slider(5, range=0..10), YCoordinate=number_slider_5, ZCoordinate=0)
pt_10 = ConstructPoint(XCoordinate=0, YCoordinate=0, ZCoordinate=0)
pt_11 = ConstructPoint(XCoordinate=Slider(10, range=0..10), YCoordinate=Slider(3, range=0..10), ZCoordinate=0)
pt_12 = ConstructPoint(XCoordinate=0, YCoordinate=0, ZCoordinate=0)
panel_8 = Panel("TwoPointsToGraphPartMilimeters_TwoPointsTrue_DeconstructWeight")
two_points_to_graph_part_4 = TwoPointsToGraphPart(PointA=pt_10, PointB=pt_9, IsDirected=True)
two_points_to_graph_part_5 = TwoPointsToGraphPart(PointA=pt_12, PointB=pt_11, IsDirected=Toggle(False))
txt_2 = Text("""Graph Part
Is Directed: True
Edge Weight: 5.8309518948453""")
deconstruct_graph_part_2 = DeconstructGraphPart(GraphPart=two_points_to_graph_part_5)  # -> Vertices, Edge, IsDirected, Weight
assert_4 = Assert(TestNames="TwoPointsToGraphPartMilimeters_TwoPointsTrue_String", Expected=txt_2, Actual=two_points_to_graph_part_4)  # -> Result, FailedInfo
divide_2 = DivideCurve(Curve=deconstruct_graph_part_2.Edge, Count=10, Kinks=False)  # -> Points, Tangents, Parameters
pt_13 = Point([Point(0, 0, 0), Point(10, 3, 0)])
bool_2 = Boolean(False)
num_2 = Number(10.44030651)
pt_14 = Point([Point(0, 0, 0), Point(1, 0.3, 0), Point(2, 0.6, 0), Point(3, 0.9, 0), Point(4, 1.2, 0), Point(5, 1.5, 0), Point(6, 1.8, 0), Point(7, 2.1, 0), Point(8, 2.4, 0), Point(9, 2.7, 0), Point(10, 3, 0)])
assert_point_list_3 = AssertPointList(TestName=panel_5, ExpectedPointList=pt_13, ActualPointList=deconstruct_graph_part_2.Vertices, Tolerance="0.0001")  # -> Result, FailedInfo
assert_5 = Assert(TestNames=panel_6, Expected=bool_2, Actual=deconstruct_graph_part_2.IsDirected)  # -> Result, FailedInfo
assert_6 = Assert(TestNames=panel_8, Expected=num_2, Actual=deconstruct_graph_part_2.Weight)  # -> Result, FailedInfo
assert_point_list_4 = AssertPointList(TestName=panel_7, ExpectedPointList=pt_14, ActualPointList=divide_2.Points, Tolerance="0.0001")  # -> Result, FailedInfo
entwine_2 = Entwine(
    Branch00=assert_4.Result,
    Branch01=assert_point_list_3.Result,
    Branch02=assert_point_list_4.Result,
    Branch03=assert_5.Result,
    Branch04=assert_6.Result,
    FlattenInputs=True)  # -> flatten(Result)

# ----
# Curve To Graph Part
# Get Graph Degree
# Get Vertex Degree
# BFS Is Graph Connected
# BFS Search
# Dijkstra Search
# BFS Shortest Path
# Dijkstra Shortest Path
# A* Shortest Path
panel_9 = Panel("CurveToGraphPartMilimeters_NurbsCurveTrue_DeconstructVertices")
nurbs = NurbsCurve(
    Vertices=[Point(-23.10995343, -7.195870574, 0), Point(-6.749057302, 4.935678258, 0), Point(9.834436056, 5.492171323, 0), Point(21.74338766, -9.310544224, 0), Point(31.31506839, 2.487108769, 0)],
    Degree=3,
    Periodic=False)  # -> Curve, Length, Domain
nurbs_2 = NurbsCurve(
    Vertices=[Point(-23.10995343, -7.195870574, 0), Point(-6.749057302, 4.935678258, 0), Point(9.834436056, 5.492171323, 0), Point(21.74338766, -9.310544224, 0), Point(31.31506839, 2.487108769, 0)],
    Degree=3,
    Periodic=False)  # -> Curve, Length, Domain
nurbs_3 = NurbsCurve(
    Vertices=[Point(-23.10995343, -7.195870574, 0), Point(-6.749057302, 4.935678258, 0), Point(9.834436056, 5.492171323, 0), Point(21.74338766, -9.310544224, 0), Point(31.31506839, 2.487108769, 0)],
    Degree=3,
    Periodic=False)  # -> Curve, Length, Domain
panel_10 = Panel("CurveToGraphPartMilimeters_NurbsCurveFalse_DeconstructIsDirected")
nurbs_4 = NurbsCurve(
    Vertices=[Point(-23.10995343, -7.195870574, 0), Point(-6.749057302, 4.935678258, 0), Point(9.834436056, 5.492171323, 0), Point(21.74338766, -9.310544224, 0), Point(31.31506839, 2.487108769, 0)],
    Degree=3,
    Periodic=False)  # -> Curve, Length, Domain
panel_11 = Panel("CurveToGraphPartMilimeters_NurbsCurveTrue_DeconstructIsDirected")
panel_12 = Panel("CurveToGraphPartMilimeters_NurbsCurveTrue_DeconstructWeight")
cir = Circle(Plane=PlaneXY(0, 0, 0), Radius=1)
crv_2 = Curve(nurbs.Curve)
crv_3 = Curve(nurbs_2.Curve)
crv_4 = Curve(nurbs_3.Curve)
crv_5 = Curve(nurbs_4.Curve)
curve_to_graph_part = CurveToGraphPart(Curve=crv_2, IsDirected=Toggle(False))
curve_to_graph_part_2 = CurveToGraphPart(Curve=crv_3, IsDirected=Toggle(True))
curve_to_graph_part_3 = CurveToGraphPart(Curve=crv_4, IsDirected=Toggle(True))
curve_to_graph_part_4 = CurveToGraphPart(Curve=cir, IsDirected=True)
curve_to_graph_part_5 = CurveToGraphPart(Curve=crv_5, IsDirected=Toggle(False))
txt_3 = Text("""Graph Part
Is Directed: False
Edge Weight: 61.1190340271855""")
txt_4 = Text("""Graph Part
Is Directed: True
Edge Weight: 61.1190340271855""")
deconstruct_graph_part_3 = DeconstructGraphPart(GraphPart=curve_to_graph_part_3)  # -> Vertices, Edge, IsDirected, Weight
deconstruct_graph_part_4 = DeconstructGraphPart(GraphPart=curve_to_graph_part_4)  # -> Vertices, Edge, IsDirected, Weight
# Naming convencion:
# ComponentNameUnits_Input_Output
assert_7 = Assert(TestNames="CurveToGraphPartMilimeters_NurbsCurveFalse_String", Expected=txt_3, Actual=curve_to_graph_part)  # -> Result, FailedInfo
assert_8 = Assert(TestNames="CurveToGraphPartMilimeters_NurbsCurveTrue_String", Expected=txt_4, Actual=curve_to_graph_part_2)  # -> Result, FailedInfo
deconstruct_graph_part_5 = DeconstructGraphPart(GraphPart=curve_to_graph_part_5)  # -> Vertices, Edge, IsDirected, Weight
divide_3 = DivideCurve(Curve=deconstruct_graph_part_3.Edge, Count=10, Kinks=False)  # -> Points, Tangents, Parameters
pt_15 = Point([Point(-23.10995343, -7.195870574, 0), Point(31.31506839, 2.487108769, 0)])
divide_4 = DivideCurve(Curve=deconstruct_graph_part_4.Edge, Count=10, Kinks=False)  # -> Points, Tangents, Parameters
bool_3 = Boolean(True)
pt_16 = Point([Point(-23.10995343, -7.195870574, 0), Point(-18.10725183, -3.686083312, 0), Point(-12.87478231, -0.5310599797, 0), Point(-7.331270421, 2.031000878, 0), Point(-1.418094952, 3.516607478, 0), Point(4.650486706, 3.159345084, 0), Point(10.26149537, 0.7897934307, 0), Point(15.52763009, -2.31038664, 0), Point(21.3516931, -3.926966628, 0), Point(26.9782872, -1.796066674, 0), Point(31.31506839, 2.487108769, 0)])
num_3 = Number(61.11903403)
pt_17 = Point([Point(1, 0, 0), Point(1, 0, 0)])
assert_point_list_5 = AssertPointList(TestName=panel_9, ExpectedPointList=pt_15, ActualPointList=deconstruct_graph_part_3.Vertices, Tolerance="0.0001")  # -> Result, FailedInfo
pt_18 = Point([Point(1, 0, 0), Point(0.8090169933, 0.5877852537, 0), Point(0.3090169582, 0.9510565281, 0), Point(-0.3090169866, 0.9510565188, 0), Point(-0.809016997, 0.5877852487, 0), Point(-1, 0, 0), Point(-0.8090169933, -0.5877852537, 0), Point(-0.3090169582, -0.9510565281, 0), Point(0.3090169866, -0.9510565188, 0), Point(0.809016997, -0.5877852487, 0)])
bool_4 = Boolean(False)
assert_9 = Assert(TestNames=panel_11, Expected=bool_3, Actual=deconstruct_graph_part_3.IsDirected)  # -> Result, FailedInfo
assert_10 = Assert(TestNames=panel_12, Expected=num_3, Actual=deconstruct_graph_part_3.Weight)  # -> Result, FailedInfo
assert_point_list_6 = AssertPointList(
    TestName="CurveToGraphPartMilimeters_NurbsCurveTrue_DeconstructEdges",
    ExpectedPointList=pt_16,
    ActualPointList=divide_3.Points,
    Tolerance="0.0001")  # -> Result, FailedInfo
assert_point_list_7 = AssertPointList(
    TestName="CurveToGraphPartMilimeters_Circle_DeconstructVertices",
    ExpectedPointList=pt_17,
    ActualPointList=deconstruct_graph_part_4.Vertices,
    Tolerance="0.0001")  # -> Result, FailedInfo
assert_11 = Assert(TestNames=panel_10, Expected=bool_4, Actual=deconstruct_graph_part_5.IsDirected)  # -> Result, FailedInfo
assert_point_list_8 = AssertPointList(
    TestName="CurveToGraphPartMilimeters_Circle_DeconstructEdges",
    ExpectedPointList=pt_18,
    ActualPointList=divide_4.Points,
    Tolerance="0.0001")  # -> Result, FailedInfo
entwine_3 = Entwine(
    Branch00=assert_7.Result,
    Branch01=assert_8.Result,
    Branch02=assert_point_list_5.Result,
    Branch03=assert_point_list_6.Result,
    Branch04=assert_9.Result,
    Branch05=assert_10.Result,
    Branch06=assert_11.Result,
    Branch07=assert_point_list_7.Result,
    Branch08=assert_point_list_8.Result,
    FlattenInputs=True)  # -> flatten(Result)

# ----
# Create Graph
number_slider_6 = Slider(10, range=0..10)
number_slider_7 = Slider(5, range=0..10)
pt_19 = ConstructPoint(XCoordinate=0, YCoordinate=0, ZCoordinate=0)
pt_20 = ConstructPoint(XCoordinate=number_slider_6, YCoordinate=0, ZCoordinate=0)
pt_21 = ConstructPoint(XCoordinate=0, YCoordinate=0, ZCoordinate=0)
pt_22 = ConstructPoint(XCoordinate=Slider(10, range=0..10), YCoordinate=0, ZCoordinate=0)
toggle_2 = BooleanToggle(True)
toggle_3 = BooleanToggle(True)
two_points_to_graph_part_6 = TwoPointsToGraphPart(PointA=pt_19, PointB=pt_20, IsDirected=Toggle(True))
pt_23 = ConstructPoint(XCoordinate=0, YCoordinate=0, ZCoordinate=0)
pt_24 = ConstructPoint(XCoordinate=Slider(10, range=0..10), YCoordinate=0, ZCoordinate=0)
pt_25 = ConstructPoint(XCoordinate=0, YCoordinate=0, ZCoordinate=0)
pt_26 = ConstructPoint(XCoordinate=Slider(10, range=0..10), YCoordinate=Slider(5, range=0..10), ZCoordinate=0)
pt_27 = ConstructPoint(XCoordinate=0, YCoordinate=0, ZCoordinate=0)
pt_28 = ConstructPoint(XCoordinate=Slider(10, range=0..10), YCoordinate=0, ZCoordinate=0)
pt_29 = ConstructPoint(XCoordinate=0, YCoordinate=number_slider_7, ZCoordinate=0)
pt_30 = ConstructPoint(XCoordinate=Slider(10, range=0..10), YCoordinate=number_slider_7, ZCoordinate=0)
two_points_to_graph_part_7 = TwoPointsToGraphPart(PointA=pt_21, PointB=pt_22, IsDirected=Toggle(False))
toggle_4 = BooleanToggle(True)
two_points_to_graph_part_8 = TwoPointsToGraphPart(PointA=pt_25, PointB=pt_26, IsDirected=toggle_2)
two_points_to_graph_part_9 = TwoPointsToGraphPart(PointA=pt_29, PointB=pt_30, IsDirected=toggle_3)
two_points_to_graph_part_10 = TwoPointsToGraphPart(PointA=pt_23, PointB=pt_24, IsDirected=toggle_2)
two_points_to_graph_part_11 = TwoPointsToGraphPart(PointA=pt_27, PointB=pt_28, IsDirected=toggle_3)
pt_31 = ConstructPoint(XCoordinate=0, YCoordinate=0, ZCoordinate=0)
pt_32 = ConstructPoint(XCoordinate=Slider(10, range=0..10), YCoordinate=0, ZCoordinate=0)
pt_33 = ConstructPoint(XCoordinate=0, YCoordinate=0, ZCoordinate=0)
pt_34 = ConstructPoint(XCoordinate=Slider(5, range=0..10), YCoordinate=Slider(5, range=0..10), ZCoordinate=0)
create_graph_2 = CreateGraph(GraphParts=two_points_to_graph_part_6, Tolerance=0.0001)
create_graph_3 = CreateGraph(GraphParts=two_points_to_graph_part_7, Tolerance=0.0001)
deconstruct_graph_2 = DeconstructGraph(Graph=create_graph_3)  # -> GraphArray, Vertices, Edges, AdjacencyList
deconstruct_graph_3 = DeconstructGraph(Graph=create_graph_2)  # -> GraphArray, Vertices, Edges, AdjacencyList
two_points_to_graph_part_12 = TwoPointsToGraphPart(PointA=pt_33, PointB=pt_34, IsDirected=toggle_4)
two_points_to_graph_part_13 = TwoPointsToGraphPart(PointA=pt_32, PointB=pt_34, IsDirected=toggle_4)
two_points_to_graph_part_14 = TwoPointsToGraphPart(PointA=pt_31, PointB=pt_32, IsDirected=toggle_4)
crv_6 = Curve(deconstruct_graph_3.Edges)
crv_7 = Curve(deconstruct_graph_2.Edges)
panel_13 = Panel(deconstruct_graph_3.AdjacencyList)
panel_14 = Panel(deconstruct_graph_2.AdjacencyList)
create_graph_4 = CreateGraph(GraphParts=[two_points_to_graph_part_10, two_points_to_graph_part_8], Tolerance=0.0001)
deconstruct_graph_4 = DeconstructGraph(Graph=create_graph_4)  # -> GraphArray, Vertices, Edges, AdjacencyList
crv_8 = Curve(deconstruct_graph_4.Edges)
panel_15 = Panel(deconstruct_graph_4.AdjacencyList)
create_graph_5 = CreateGraph(GraphParts=[two_points_to_graph_part_11, two_points_to_graph_part_9], Tolerance=0.0001)
deconstruct_graph_5 = DeconstructGraph(Graph=create_graph_5)  # -> GraphArray, Vertices, Edges, AdjacencyList
divide_5 = DivideCurve(Curve=crv_8, Count=10, Kinks=False)  # -> flatten(Points), Tangents, Parameters
txt_5 = Text("""Graph
Vertices: 2
Edges: 1""")
divide_6 = DivideCurve(Curve=crv_7, Count=10, Kinks=False)  # -> flatten(Points), Tangents, Parameters
divide_7 = DivideCurve(Curve=crv_6, Count=10, Kinks=False)  # -> Points, Tangents, Parameters
txt_6 = Text("""Graph
Vertices: 2
Edges: 2""")
panel_16 = Panel(deconstruct_graph_3.GraphArray)
panel_17 = Panel(deconstruct_graph_4.GraphArray)
txt_7 = Text("0;1")
txt_8 = Text(["0;1", "0;2"])
panel_18 = Panel(deconstruct_graph_2.GraphArray)
txt_9 = Text("""Graph
Vertices: 3
Edges: 2""")
txt_10 = Text(["1;", ""])
txt_11 = Text(["1;2;", "", ""])
crv_9 = Curve(deconstruct_graph_5.Edges)
txt_12 = Text(["0;1", "1;0"])
pt_35 = Point([Point(0, 0, 0), Point(10, 0, 0), Point(10, 5, 0)])
txt_13 = Text("""Graph
Vertices: 4
Edges: 2""")
pt_36 = Point([Point(0, 0, 0), Point(10, 0, 0)])
txt_14 = Text(["1;", "0;"])
pt_37 = Point([Point(0, 0, 0), Point(10, 0, 0)])
pt_38 = Point([Point(0, 0, 0), Point(1, 0, 0), Point(2, 0, 0), Point(3, 0, 0), Point(4, 0, 0), Point(5, 0, 0), Point(6, 0, 0), Point(7, 0, 0), Point(8, 0, 0), Point(9, 0, 0), Point(10, 0, 0)])
pt_39 = Point([Point(0, 0, 0), Point(1, 0, 0), Point(2, 0, 0), Point(3, 0, 0), Point(4, 0, 0), Point(5, 0, 0), Point(6, 0, 0), Point(7, 0, 0), Point(8, 0, 0), Point(9, 0, 0), Point(10, 0, 0), Point(0, 0, 0), Point(1, 0.5, 0), Point(2, 1, 0), Point(3, 1.5, 0), Point(4, 2, 0), Point(5, 2.5, 0), Point(6, 3, 0), Point(7, 3.5, 0), Point(8, 4, 0), Point(9, 4.5, 0), Point(10, 5, 0)])
panel_19 = Panel(deconstruct_graph_5.AdjacencyList)
pt_40 = Point([Point(0, 0, 0), Point(1, 0, 0), Point(2, 0, 0), Point(3, 0, 0), Point(4, 0, 0), Point(5, 0, 0), Point(6, 0, 0), Point(7, 0, 0), Point(8, 0, 0), Point(9, 0, 0), Point(10, 0, 0), Point(10, 0, 0), Point(9, 0, 0), Point(8, 0, 0), Point(7, 0, 0), Point(6, 0, 0), Point(5, 0, 0), Point(4, 0, 0), Point(3, 0, 0), Point(2, 0, 0), Point(1, 0, 0), Point(0, 0, 0)])
assert_12 = Assert(TestNames="CreateGraphMilimeters_1GraphPart_String", Expected=txt_5, Actual=create_graph_2)  # -> Result, FailedInfo
assert_13 = Assert(TestNames="CreateGraphMilimeters_1GraphPartUndirected_String", Expected=txt_6, Actual=create_graph_3)  # -> Result, FailedInfo
divide_8 = DivideCurve(Curve=crv_9, Count=10, Kinks=False)  # -> flatten(Points), Tangents, Parameters
create_graph_6 = CreateGraph(GraphParts=[two_points_to_graph_part_14, two_points_to_graph_part_12, two_points_to_graph_part_13], Tolerance=0.0001)
deconstruct_graph_6 = DeconstructGraph(Graph=create_graph_6)  # -> GraphArray, Vertices, Edges, AdjacencyList
crv_10 = Curve(deconstruct_graph_6.Edges)
panel_20 = Panel(deconstruct_graph_6.AdjacencyList)
divide_9 = DivideCurve(Curve=crv_10, Count=10, Kinks=False)  # -> flatten(Points), Tangents, Parameters
assert_list = AssertList(TestName="CreateGraphMilimeters_2GraphParts_GraphArray", ExpectedList=txt_8, ActualList=panel_17)  # -> Result, FailedInfo
assert_point_list_9 = AssertPointList(
    TestName="CreateGraphMilimeters_2GraphParts_Edge",
    ExpectedPointList=pt_39,
    ActualPointList=divide_5.Points,
    Tolerance="0.0001")  # -> Result, FailedInfo
assert_point_list_10 = AssertPointList(
    TestName="CreateGraphMilimeters_2GraphParts_Vertices",
    ExpectedPointList=pt_35,
    ActualPointList=deconstruct_graph_4.Vertices,
    Tolerance="0.0001")  # -> Result, FailedInfo
assert_point_list_11 = AssertPointList(
    TestName="CreateGraphMilimeters_1GraphPart_Edge",
    ExpectedPointList=pt_38,
    ActualPointList=divide_7.Points,
    Tolerance="0.0001")  # -> Result, FailedInfo
assert_list_2 = AssertList(TestName="CreateGraphMilimeters_2GraphParts_AdjacencyList", ExpectedList=txt_11, ActualList=panel_15)  # -> Result, FailedInfo
assert_point_list_12 = AssertPointList(
    TestName="CreateGraphMilimeters_1GraphPart_Vertices",
    ExpectedPointList=pt_36,
    ActualPointList=deconstruct_graph_3.Vertices,
    Tolerance="0.0001")  # -> Result, FailedInfo
assert_14 = Assert(TestNames="CreateGraphMilimeters_1GraphPart_GraphArray", Expected=txt_7, Actual=panel_16)  # -> Result, FailedInfo
assert_list_3 = AssertList(TestName="CreateGraphMilimeters_1GraphPart_AdjacencyList", ExpectedList=txt_10, ActualList=panel_13)  # -> Result, FailedInfo
assert_15 = Assert(TestNames="CreateGraphMilimeters_2GraphParts_String", Expected=txt_9, Actual=create_graph_4)  # -> Result, FailedInfo
panel_21 = Panel(deconstruct_graph_6.GraphArray)
assert_list_4 = AssertList(TestName="CreateGraphMilimeters_1GraphPartUndirected_GraphArray", ExpectedList=txt_12, ActualList=panel_18)  # -> Result, FailedInfo
assert_point_list_13 = AssertPointList(
    TestName="CreateGraphMilimeters_1GraphPartUndirected_Edge",
    ExpectedPointList=pt_40,
    ActualPointList=divide_6.Points,
    Tolerance="0.0001")  # -> Result, FailedInfo
assert_point_list_14 = AssertPointList(
    TestName="CreateGraphMilimeters_1GraphPartUndirected_Vertices",
    ExpectedPointList=pt_37,
    ActualPointList=deconstruct_graph_2.Vertices,
    Tolerance="0.0001")  # -> Result, FailedInfo
assert_list_5 = AssertList(TestName="CreateGraphMilimeters_1GraphPartUndirected_AdjacencyList", ExpectedList=txt_14, ActualList=panel_14)  # -> Result, FailedInfo
txt_15 = Text(["0;1", "0;2", "1;2"])
assert_16 = Assert(TestNames="CreateGraphMilimeters_2SeparateGraphParts_String", Expected=txt_13, Actual=create_graph_5)  # -> Result, FailedInfo
txt_16 = Text(["1;2;", "2;", ""])
pt_41 = Point([Point(0, 0, 0), Point(10, 0, 0), Point(5, 5, 0)])
panel_22 = Panel(deconstruct_graph_5.GraphArray)
pt_42 = Point([Point(0, 0, 0), Point(1, 0, 0), Point(2, 0, 0), Point(3, 0, 0), Point(4, 0, 0), Point(5, 0, 0), Point(6, 0, 0), Point(7, 0, 0), Point(8, 0, 0), Point(9, 0, 0)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])
txt_17 = Text(["0;1", "2;3"])
txt_18 = Text(["1;", "", "3;", ""])
pt_43 = Point([Point(0, 0, 0), Point(10, 0, 0), Point(0, 5, 0), Point(10, 5, 0)])
pt_44 = Point([Point(0, 0, 0), Point(1, 0, 0), Point(2, 0, 0), Point(3, 0, 0), Point(4, 0, 0), Point(5, 0, 0), Point(6, 0, 0), Point(7, 0, 0), Point(8, 0, 0), Point(9, 0, 0), Point(10, 0, 0), Point(0, 5, 0), Point(1, 5, 0), Point(2, 5, 0), Point(3, 5, 0), Point(4, 5, 0), Point(5, 5, 0), Point(6, 5, 0), Point(7, 5, 0), Point(8, 5, 0), Point(9, 5, 0), Point(10, 5, 0)])
txt_19 = Text("""Graph
Vertices: 3
Edges: 3""")
assert_point_list_15 = AssertPointList(
    TestName="CreateGraphMilimeters_Triangle_Vertices",
    ExpectedPointList=pt_41,
    ActualPointList=deconstruct_graph_6.Vertices,
    Tolerance="0.0001")  # -> Result, FailedInfo
assert_list_6 = AssertList(TestName="CreateGraphMilimeters_Triangle_GraphArray", ExpectedList=txt_15, ActualList=panel_21)  # -> Result, FailedInfo
assert_point_list_16 = AssertPointList(
    TestName="CreateGraphMilimeters_Triangle_Edge",
    ExpectedPointList=pt_42,
    ActualPointList=divide_9.Points,
    Tolerance="0.0001")  # -> Result, FailedInfo
assert_list_7 = AssertList(TestName="CreateGraphMilimeters_Triangle_AdjacencyList", ExpectedList=txt_16, ActualList=panel_20)  # -> Result, FailedInfo
assert_list_8 = AssertList(TestName="CreateGraphMilimeters_2SeparateGraphParts_GraphArray", ExpectedList=txt_17, ActualList=panel_22)  # -> Result, FailedInfo
assert_point_list_17 = AssertPointList(
    TestName="CreateGraphMilimeters_2SeparateGraphParts_Edge",
    ExpectedPointList=pt_44,
    ActualPointList=divide_8.Points,
    Tolerance="0.0001")  # -> Result, FailedInfo
assert_point_list_18 = AssertPointList(
    TestName="CreateGraphMilimeters_2SeparateGraphParts_Vertices",
    ExpectedPointList=pt_43,
    ActualPointList=deconstruct_graph_5.Vertices,
    Tolerance="0.0001")  # -> Result, FailedInfo
assert_list_9 = AssertList(TestName="CreateGraphMilimeters_2SeparateGraphParts_AdjacencyList", ExpectedList=txt_18, ActualList=panel_19)  # -> Result, FailedInfo
assert_17 = Assert(TestNames="CreateGraphMilimeters_Triangle_String", Expected=txt_19, Actual=create_graph_6)  # -> Result, FailedInfo
entwine_4 = Entwine(
    Branch00=assert_13.Result,
    Branch01=assert_list_4.Result,
    Branch02=assert_point_list_14.Result,
    Branch03=assert_point_list_13.Result,
    Branch04=assert_list_5.Result,
    FlattenInputs=True)  # -> flatten(Result)
entwine_5 = Entwine(
    Branch00=assert_15.Result,
    Branch01=assert_list.Result,
    Branch02=assert_point_list_10.Result,
    Branch03=assert_point_list_9.Result,
    Branch04=assert_list_2.Result,
    FlattenInputs=True)  # -> flatten(Result)
entwine_6 = Entwine(
    Branch00=assert_12.Result,
    Branch01=assert_14.Result,
    Branch02=assert_point_list_12.Result,
    Branch03=assert_point_list_11.Result,
    Branch04=assert_list_3.Result,
    FlattenInputs=True)  # -> flatten(Result)
entwine_7 = Entwine(
    Branch00=assert_16.Result,
    Branch01=assert_list_8.Result,
    Branch02=assert_point_list_18.Result,
    Branch03=assert_point_list_17.Result,
    Branch04=assert_list_9.Result,
    FlattenInputs=True)  # -> flatten(Result)
entwine_8 = Entwine(
    Branch00=assert_17.Result,
    Branch01=assert_list_6.Result,
    Branch02=assert_point_list_15.Result,
    Branch03=assert_point_list_16.Result,
    Branch04=assert_list_7.Result,
    FlattenInputs=True)  # -> flatten(Result)
entwine_9 = Entwine(Branch00=entwine_6, Branch01=entwine_4, Branch02=entwine_7, Branch03=entwine_5, Branch04=entwine_8, FlattenInputs=True)  # -> flatten(Result)

# ----
# Mesh To Graph
pt_45 = Point(Point(10, 10, 0))
pt_46 = Point(Point(0, 10, 0))
pt_47 = Point(Point(0, 0, 0))
pt_48 = Point(Point(10, 0, 0))
face = MeshFace({A=0, B=1, C=2, D=3})
pt_49 = Point(Point(10, 10, 0))
pt_50 = Point(Point(0, 0, 0))
pt_51 = Point(Point(10, 0, 0))
face_2 = MeshFace({A=0, B=2, C=1, D=1})
pt_52 = Point(Point(10, 10, 0))
pt_53 = Point(Point(0, 10, 0))
pt_54 = Point(Point(0, 0, 0))
pt_55 = Point(Point(10, 0, 0))
face_3 = MeshFace({A=0, B=2, C=1, D=1})
face_4 = MeshFace({A=0, B=3, C=2, D=2})
conmesh = ConstructMesh(Vertices=[pt_47, pt_48, pt_45, pt_46], Faces=face)
conmesh_2 = ConstructMesh(Vertices=[pt_50, pt_51, pt_49], Faces=face_2)
pt_56 = Point([Point(7.608514279, 2.629216732, 0), Point(-3.344938733, 10.66174894, 0), Point(8.33874448, 21.90729403, 0), Point(19.29219749, 20.59287967, 0), Point(30.6107656, 8.836173438, 0), Point(29.07728218, 1.38782539, 0), Point(17.39359897, -8.762374401, 0), Point(2.423879854, -8.10516722, 0)])
conmesh_3 = ConstructMesh(Vertices=[pt_54, pt_55, pt_52, pt_53], Faces=[face_3, face_4])
number_slider_8 = Slider(5, range=0..110)
mesh_to_graph = MeshToGraph(Mesh=conmesh)
nurbs_5 = NurbsCurve(Vertices=pt_56, Degree=3, Periodic=True)  # -> Curve, Length, Domain
mesh_to_graph_2 = MeshToGraph(Mesh=conmesh_2)
mesh_to_graph_3 = MeshToGraph(Mesh=conmesh_3)
boundary = BoundarySurfaces(Edges=nurbs_5.Curve)
deconstruct_graph_7 = DeconstructGraph(Graph=mesh_to_graph)  # -> GraphArray, Vertices, Edges, AdjacencyList
crv_11 = Curve(deconstruct_graph_7.Edges)
deconstruct_graph_8 = DeconstructGraph(Graph=mesh_to_graph_2)  # -> GraphArray, Vertices, Edges, AdjacencyList
panel_23 = Panel(deconstruct_graph_7.AdjacencyList)
crv_12 = Curve(deconstruct_graph_8.Edges)
panel_24 = Panel(deconstruct_graph_8.AdjacencyList)
deconstruct_graph_9 = DeconstructGraph(Graph=mesh_to_graph_3)  # -> GraphArray, Vertices, Edges, AdjacencyList
crv_13 = Curve(deconstruct_graph_9.Edges)
divide_10 = DivideCurve(Curve=crv_11, Count=10, Kinks=False)  # -> flatten(Points), Tangents, Parameters
mesh_uv = MeshSurface(Surface=boundary, UCount=number_slider_8, VCount=number_slider_8, Overhang=True, Equalize=False)
panel_25 = Panel(deconstruct_graph_9.AdjacencyList)
divide_11 = DivideCurve(Curve=crv_12, Count=10, Kinks=False)  # -> flatten(Points), Tangents, Parameters
txt_20 = Text("""Graph
Vertices: 4
Edges: 8""")
panel_26 = Panel(deconstruct_graph_7.GraphArray)
txt_21 = Text(["0;1", "1;0", "0;3", "3;0", "1;2", "2;1", "2;3", "3;2"])
divide_12 = DivideCurve(Curve=crv_13, Count=10, Kinks=False)  # -> flatten(Points), Tangents, Parameters
txt_22 = Text(["1;3;", "0;2;", "1;3;", "0;2;"])
txt_23 = Text("""Graph
Vertices: 3
Edges: 6""")
pt_57 = Point([Point(0, 0, 0), Point(10, 0, 0), Point(10, 10, 0), Point(0, 10, 0)])
panel_27 = Panel(deconstruct_graph_8.GraphArray)
txt_24 = Text(["0;1", "1;0", "0;2", "2;0", "1;2", "2;1"])
pt_58 = Point([Point(0, 0, 0), Point(1, 0, 0), Point(2, 0, 0), Point(3, 0, 0), Point(4, 0, 0), Point(5, 0, 0)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])
txt_25 = Text(["1;2;", "0;2;", "0;1;"])
pt_59 = Point([Point(0, 0, 0), Point(10, 0, 0), Point(10, 10, 0)])
txt_26 = Text("""Graph
Vertices: 4
Edges: 10""")
panel_28 = Panel(deconstruct_graph_9.GraphArray)
txt_27 = Text(["0;1", "1;0", "0;2", "2;0", "0;3", "3;0", "1;2", "2;1", "2;3", "3;2"])
pt_60 = Point([Point(0, 0, 0), Point(1, 0, 0), Point(2, 0, 0), Point(3, 0, 0), Point(4, 0, 0), Point(5, 0, 0)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])
mesh_to_graph_4 = MeshToGraph(Mesh=mesh_uv)
deconstruct_graph_10 = DeconstructGraph(Graph=mesh_to_graph_4)  # -> GraphArray, Vertices, Edges, AdjacencyList
crv_14 = Curve(deconstruct_graph_10.Edges)
txt_28 = Text(["1;2;3;", "0;2;", "0;1;3;", "0;2;"])
assert_18 = Assert(TestNames="CreateGraphMilimeters_1FaceQuad_String", Expected=txt_20, Actual=mesh_to_graph)  # -> Result, FailedInfo
panel_29 = Panel(deconstruct_graph_10.AdjacencyList)
pt_61 = Point([Point(0, 0, 0), Point(10, 0, 0), Point(10, 10, 0), Point(0, 10, 0)])
pt_62 = Point([Point(0, 0, 0), Point(1, 0, 0), Point(2, 0, 0), Point(3, 0, 0), Point(4, 0, 0), Point(5, 0, 0)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])
assert_list_10 = AssertList(TestName="CreateGraphMilimeters_1FaceQuad_GraphArray", ExpectedList=txt_21, ActualList=panel_26)  # -> Result, FailedInfo
assert_19 = Assert(TestNames="CreateGraphMilimeters_1FaceTri_String", Expected=txt_23, Actual=mesh_to_graph_2)  # -> Result, FailedInfo
assert_point_list_19 = AssertPointList(
    TestName="CreateGraphMilimeters_1FaceQuad_Edge",
    ExpectedPointList=pt_58,
    ActualPointList=divide_10.Points,
    Tolerance="0.0001")  # -> Result, FailedInfo
assert_point_list_20 = AssertPointList(
    TestName="CreateGraphMilimeters_1FaceQuad_Vertices",
    ExpectedPointList=pt_57,
    ActualPointList=deconstruct_graph_7.Vertices,
    Tolerance="0.0001")  # -> Result, FailedInfo
assert_list_11 = AssertList(TestName="CreateGraphMilimeters_1FaceQuad_AdjacencyList", ExpectedList=txt_22, ActualList=panel_23)  # -> Result, FailedInfo
divide_13 = DivideCurve(Curve=crv_14, Count=10, Kinks=False)  # -> flatten(Points), Tangents, Parameters
assert_list_12 = AssertList(TestName="CreateGraphMilimeters_1FaceTri_GraphArray", ExpectedList=txt_24, ActualList=panel_27)  # -> Result, FailedInfo
assert_point_list_21 = AssertPointList(
    TestName="CreateGraphMilimeters_1FaceTri_Edge",
    ExpectedPointList=pt_60,
    ActualPointList=divide_11.Points,
    Tolerance="0.0001")  # -> Result, FailedInfo
assert_point_list_22 = AssertPointList(
    TestName="CreateGraphMilimeters_1FaceTri_Vertices",
    ExpectedPointList=pt_59,
    ActualPointList=deconstruct_graph_8.Vertices,
    Tolerance="0.0001")  # -> Result, FailedInfo
assert_list_13 = AssertList(TestName="CreateGraphMilimeters_1FaceTri_AdjacencyList", ExpectedList=txt_25, ActualList=panel_24)  # -> Result, FailedInfo
assert_20 = Assert(TestNames="CreateGraphMilimeters_2FaceTri_String", Expected=txt_26, Actual=mesh_to_graph_3)  # -> Result, FailedInfo
assert_list_14 = AssertList(TestName="CreateGraphMilimeters_2FaceTri_GraphArray", ExpectedList=txt_27, ActualList=panel_28)  # -> Result, FailedInfo
assert_point_list_23 = AssertPointList(
    TestName="CreateGraphMilimeters_2FaceTri_Edge",
    ExpectedPointList=pt_62,
    ActualPointList=divide_12.Points,
    Tolerance="0.0001")  # -> Result, FailedInfo
assert_point_list_24 = AssertPointList(
    TestName="CreateGraphMilimeters_2FaceTri_Vertices",
    ExpectedPointList=pt_61,
    ActualPointList=deconstruct_graph_9.Vertices,
    Tolerance="0.0001")  # -> Result, FailedInfo
assert_list_15 = AssertList(TestName="CreateGraphMilimeters_2FaceTri_AdjacencyList", ExpectedList=txt_28, ActualList=panel_25)  # -> Result, FailedInfo
txt_29 = Text("""Graph
Vertices: 34
Edges: 112""")
panel_30 = Panel(deconstruct_graph_10.GraphArray)
txt_30 = Text(["0;1", "1;0", "0;6", "6;0", "1;2", "2;1", "1;7", "7;1", "2;3", "3;2"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])
pt_63 = Point([Point(0.008278349409, 21.76928052, 0), Point(0.008278349409, 15.64673843, 0), Point(0.008278349409, 9.524196334, 0), Point(0.008278349409, 3.401654238, 0), Point(0.008278349409, -2.720887857, 0), Point(0.008278349409, -8.843429953, 0)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])
txt_31 = Text(["1;6;", "0;2;7;", "1;3;8;", "2;4;9;", "3;5;10;", "4;11;", "0;7;12;", "1;6;8;13;", "2;7;9;14;", "3;8;10;15;", "4;9;11;16;", "5;10;17;", "6;13;18;", "7;12;14;19;", "8;13;15;20;", "9;14;16;21;", "10;15;17;22;", "11;16;23;", "12;19;24;", "13;18;20;25;", "14;19;21;26;", "15;20;22;27;", "16;21;23;28;", "17;22;29;", "18;25;", "19;24;26;30;", "20;25;27;31;", "21;26;28;32;", "22;27;29;33;", "23;28;", "25;31;", "26;30;32;", "27;31;33;", "28;32;"])
pt_64 = Point([Point(0.008278349409, 21.76928052, 0), Point(0.008278349409, 21.15702632, 0), Point(0.008278349409, 20.54477211, 0), Point(0.008278349409, 19.9325179, 0), Point(0.008278349409, 19.32026369, 0), Point(0.008278349409, 18.70800948, 0)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])
assert_21 = Assert(TestNames="CreateGraphMilimeters_SurfaceToMesh_String", Expected=txt_29, Actual=mesh_to_graph_4)  # -> Result, FailedInfo
assert_list_16 = AssertList(TestName="CreateGraphMilimeters_SurfaceToMesh_GraphArray", ExpectedList=txt_30, ActualList=panel_30)  # -> Result, FailedInfo
assert_point_list_25 = AssertPointList(
    TestName="CreateGraphMilimeters_SurfaceToMesh_Edge",
    ExpectedPointList=pt_64,
    ActualPointList=divide_13.Points,
    Tolerance="0.0001")  # -> Result, FailedInfo
assert_point_list_26 = AssertPointList(
    TestName="CreateGraphMilimeters_SurfaceToMesh_Vertices",
    ExpectedPointList=pt_63,
    ActualPointList=deconstruct_graph_10.Vertices,
    Tolerance="0.0001")  # -> Result, FailedInfo
assert_list_17 = AssertList(TestName="CreateGraphMilimeters_SurfaceToMesh_AdjacencyList", ExpectedList=txt_31, ActualList=panel_29)  # -> Result, FailedInfo
entwine_10 = Entwine(
    Branch00=assert_18.Result,
    Branch01=assert_list_10.Result,
    Branch02=assert_point_list_20.Result,
    Branch03=assert_point_list_19.Result,
    Branch04=assert_list_11.Result,
    FlattenInputs=True)  # -> flatten(Result)
entwine_11 = Entwine(
    Branch00=assert_19.Result,
    Branch01=assert_list_12.Result,
    Branch02=assert_point_list_22.Result,
    Branch03=assert_point_list_21.Result,
    Branch04=assert_list_13.Result,
    FlattenInputs=True)  # -> flatten(Result)
entwine_12 = Entwine(
    Branch00=assert_20.Result,
    Branch01=assert_list_14.Result,
    Branch02=assert_point_list_24.Result,
    Branch03=assert_point_list_23.Result,
    Branch04=assert_list_15.Result,
    FlattenInputs=True)  # -> flatten(Result)
entwine_13 = Entwine(
    Branch00=assert_21.Result,
    Branch01=assert_list_16.Result,
    Branch02=assert_point_list_26.Result,
    Branch03=assert_point_list_25.Result,
    Branch04=assert_list_17.Result,
    FlattenInputs=True)  # -> flatten(Result)
entwine_14 = Entwine(Branch00=entwine_10, Branch01=entwine_11, Branch02=entwine_12, Branch03=entwine_13, FlattenInputs=True)  # -> flatten(Result)

# ----
# Graph To Report Part
number_slider_9 = Slider(10, range=0..10)
panel_31 = Panel("GraphToReportPartMilimeters_1GraphPartDirectionTrueShowWeightsTrue_ReportPart")
panel_32 = Panel("GraphToReportPartMilimeters_1GraphPartDirectionFalseShowWeightsTrue_ReportPart")
panel_33 = Panel("GraphToReportPartMilimeters_1GraphPartDirectionFalseShowWeightsFalse_ReportPart")
pt_65 = ConstructPoint(XCoordinate=0, YCoordinate=0, ZCoordinate=0)
pt_66 = ConstructPoint(XCoordinate=number_slider_9, YCoordinate=0, ZCoordinate=0)
pt_67 = ConstructPoint(XCoordinate=0, YCoordinate=0, ZCoordinate=0)
pt_68 = ConstructPoint(XCoordinate=Slider(10, range=0..10), YCoordinate=0, ZCoordinate=0)
pt_69 = ConstructPoint(XCoordinate=0, YCoordinate=0, ZCoordinate=0)
pt_70 = ConstructPoint(XCoordinate=Slider(10, range=0..10), YCoordinate=0, ZCoordinate=0)
panel_34 = Panel("GraphToReportPartMilimeters_1GraphPartUndirectedDirectionTrueShowWeightsTrue_ReportPart")
panel_35 = Panel("GraphToReportPartMilimeters_1GraphPartDirectionFalseShowWeightsTrue_TextFormat")
pt_71 = ConstructPoint(XCoordinate=0, YCoordinate=0, ZCoordinate=0)
pt_72 = ConstructPoint(XCoordinate=Slider(10, range=0..10), YCoordinate=0, ZCoordinate=0)
panel_36 = Panel("GraphToReportPartMilimeters_TriangleDirectionTrueShowWeightsTrue_ReportPart")
panel_37 = Panel("GraphToReportPartMilimeters_TriangleDirectionFalseShowWeightsTrue_ReportPart")
pt_73 = ConstructPoint(XCoordinate=0, YCoordinate=0, ZCoordinate=0)
pt_74 = ConstructPoint(XCoordinate=Slider(10, range=0..10), YCoordinate=0, ZCoordinate=0)
two_points_to_graph_part_15 = TwoPointsToGraphPart(PointA=pt_65, PointB=pt_66, IsDirected=Toggle(True))
two_points_to_graph_part_16 = TwoPointsToGraphPart(PointA=pt_67, PointB=pt_68, IsDirected=Toggle(True))
two_points_to_graph_part_17 = TwoPointsToGraphPart(PointA=pt_69, PointB=pt_70, IsDirected=Toggle(True))
toggle_5 = BooleanToggle(True)
toggle_6 = BooleanToggle(True)
pt_75 = ConstructPoint(XCoordinate=0, YCoordinate=0, ZCoordinate=0)
pt_76 = ConstructPoint(XCoordinate=Slider(10, range=0..10), YCoordinate=0, ZCoordinate=0)
pt_77 = ConstructPoint(XCoordinate=0, YCoordinate=0, ZCoordinate=0)
pt_78 = ConstructPoint(XCoordinate=Slider(5, range=0..10), YCoordinate=Slider(5, range=0..10), ZCoordinate=0)
pt_79 = ConstructPoint(XCoordinate=0, YCoordinate=0, ZCoordinate=0)
pt_80 = ConstructPoint(XCoordinate=Slider(10, range=0..10), YCoordinate=0, ZCoordinate=0)
pt_81 = ConstructPoint(XCoordinate=0, YCoordinate=0, ZCoordinate=0)
pt_82 = ConstructPoint(XCoordinate=Slider(5, range=0..10), YCoordinate=Slider(5, range=0..10), ZCoordinate=0)
two_points_to_graph_part_18 = TwoPointsToGraphPart(PointA=pt_71, PointB=pt_72, IsDirected=Toggle(True))
two_points_to_graph_part_19 = TwoPointsToGraphPart(PointA=pt_73, PointB=pt_74, IsDirected=Toggle(False))
two_points_to_graph_part_20 = TwoPointsToGraphPart(PointA=pt_77, PointB=pt_78, IsDirected=toggle_5)
two_points_to_graph_part_21 = TwoPointsToGraphPart(PointA=pt_76, PointB=pt_78, IsDirected=toggle_5)
two_points_to_graph_part_22 = TwoPointsToGraphPart(PointA=pt_75, PointB=pt_76, IsDirected=toggle_5)
two_points_to_graph_part_23 = TwoPointsToGraphPart(PointA=pt_81, PointB=pt_82, IsDirected=toggle_6)
two_points_to_graph_part_24 = TwoPointsToGraphPart(PointA=pt_80, PointB=pt_82, IsDirected=toggle_6)
two_points_to_graph_part_25 = TwoPointsToGraphPart(PointA=pt_79, PointB=pt_80, IsDirected=toggle_6)
create_graph_7 = CreateGraph(GraphParts=two_points_to_graph_part_15, Tolerance=0.0001)
create_graph_8 = CreateGraph(GraphParts=two_points_to_graph_part_16, Tolerance=0.0001)
create_graph_9 = CreateGraph(GraphParts=two_points_to_graph_part_17, Tolerance=0.0001)
create_graph_10 = CreateGraph(GraphParts=two_points_to_graph_part_18, Tolerance=0.0001)
create_graph_11 = CreateGraph(GraphParts=two_points_to_graph_part_19, Tolerance=0.0001)
graph_to_report_part = GraphToReportPart(Graph=create_graph_8, Direction=Toggle(False), ShowWeights=Toggle(True), TextFormat="{0:0.00}")
graph_to_report_part_2 = GraphToReportPart(Graph=create_graph_9, Direction=Toggle(False), ShowWeights=Toggle(False), TextFormat="{0:0.00}")
graph_to_report_part_3 = GraphToReportPart(Graph=create_graph_7, Direction=Toggle(True), ShowWeights=Toggle(True), TextFormat="{0:0.00}")
create_graph_12 = CreateGraph(GraphParts=[two_points_to_graph_part_22, two_points_to_graph_part_20, two_points_to_graph_part_21], Tolerance=0.0001)
create_graph_13 = CreateGraph(GraphParts=[two_points_to_graph_part_25, two_points_to_graph_part_23, two_points_to_graph_part_24], Tolerance=0.0001)
graph_to_report_part_4 = GraphToReportPart(Graph=create_graph_10, Direction=Toggle(False), ShowWeights=Toggle(True), TextFormat="{0:0.0000}")
txt_32 = Text("""```mermaid
graph LR
0--10.00-->1;
```""")
txt_33 = Text("""```mermaid
graph TD
0--10.00-->1;
```""")
graph_to_report_part_5 = GraphToReportPart(Graph=create_graph_11, Direction=Toggle(True), ShowWeights=Toggle(True), TextFormat="{0:0.00}")
txt_34 = Text("""```mermaid
graph TD
0-->1;
```""")
txt_35 = Text("""```mermaid
graph TD
0--10.0000-->1;
```""")
graph_to_report_part_6 = GraphToReportPart(Graph=create_graph_12, Direction=Toggle(True), ShowWeights=Toggle(True), TextFormat="{0:0.00}")
txt_36 = Text("""```mermaid
graph LR
0--10.00-->1;
1--10.00-->0;
```""")
graph_to_report_part_7 = GraphToReportPart(Graph=create_graph_13, Direction=Toggle(False), ShowWeights=Toggle(True), TextFormat="{0:0.00}")
assert_22 = Assert(TestNames=panel_31, Expected=txt_32, Actual=graph_to_report_part_3)  # -> Result, FailedInfo
assert_23 = Assert(TestNames=panel_32, Expected=txt_33, Actual=graph_to_report_part)  # -> Result, FailedInfo
assert_24 = Assert(TestNames=panel_33, Expected=txt_34, Actual=graph_to_report_part_2)  # -> Result, FailedInfo
txt_37 = Text("""```mermaid
graph LR
0--10.00-->1;
0--7.07-->2;
1--7.07-->2;
```""")
txt_38 = Text("""```mermaid
graph TD
0--10.00-->1;
0--7.07-->2;
1--7.07-->2;
```""")
assert_25 = Assert(TestNames=panel_35, Expected=txt_35, Actual=graph_to_report_part_4)  # -> Result, FailedInfo
assert_26 = Assert(TestNames=panel_34, Expected=txt_36, Actual=graph_to_report_part_5)  # -> Result, FailedInfo
assert_27 = Assert(TestNames=panel_36, Expected=txt_37, Actual=graph_to_report_part_6)  # -> Result, FailedInfo
assert_28 = Assert(TestNames=panel_37, Expected=txt_38, Actual=graph_to_report_part_7)  # -> Result, FailedInfo
entwine_15 = Entwine(
    Branch00=assert_22.Result,
    Branch01=assert_23.Result,
    Branch02=assert_24.Result,
    Branch03=assert_25.Result,
    Branch04=assert_26.Result,
    Branch05=assert_27.Result,
    Branch06=assert_28.Result,
    FlattenInputs=True)  # -> flatten(Result)

pt_83 = Point([Point(7.608514279, 2.629216732, 0), Point(-3.344938733, 10.66174894, 0), Point(8.33874448, 21.90729403, 0), Point(19.29219749, 20.59287967, 0), Point(30.6107656, 8.836173438, 0), Point(29.07728218, 1.38782539, 0), Point(17.39359897, -8.762374401, 0), Point(2.423879854, -8.10516722, 0)])
number_slider_10 = Slider(5, range=0..110)
nurbs_6 = NurbsCurve(Vertices=pt_83, Degree=3, Periodic=True)  # -> Curve, Length, Domain
panel_38 = Panel("GraphToReportPartMilimeters_Mesh_TooManyEdgesException")
boundary_2 = BoundarySurfaces(Edges=nurbs_6.Curve)
mesh_uv_2 = MeshSurface(Surface=boundary_2, UCount=number_slider_10, VCount=number_slider_10, Overhang=True, Equalize=False)
mesh_to_graph_5 = MeshToGraph(Mesh=mesh_uv_2)
graph_to_report_part_8 = GraphToReportPart(Graph=mesh_to_graph_5, Direction=True, ShowWeights=True, TextFormat="{0:0.00}")

# ----
# Get Closest Vertex
pt_84 = Point([Point(7.608514279, 2.629216732, 0), Point(-3.344938733, 10.66174894, 0), Point(8.33874448, 21.90729403, 0), Point(19.29219749, 20.59287967, 0), Point(30.6107656, 8.836173438, 0), Point(29.07728218, 1.38782539, 0), Point(17.39359897, -8.762374401, 0), Point(2.423879854, -8.10516722, 0)])
pt_85 = Point([Point(7.608514279, 2.629216732, 0), Point(-3.344938733, 10.66174894, 0), Point(8.33874448, 21.90729403, 0), Point(19.29219749, 20.59287967, 0), Point(30.6107656, 8.836173438, 0), Point(29.07728218, 1.38782539, 0), Point(17.39359897, -8.762374401, 0), Point(2.423879854, -8.10516722, 0)])
number_slider_11 = Slider(5, range=0..110)
number_slider_12 = Slider(5, range=0..110)
nurbs_7 = NurbsCurve(Vertices=pt_84, Degree=3, Periodic=True)  # -> Curve, Length, Domain
nurbs_8 = NurbsCurve(Vertices=pt_85, Degree=3, Periodic=True)  # -> Curve, Length, Domain
boundary_3 = BoundarySurfaces(Edges=nurbs_7.Curve)
boundary_4 = BoundarySurfaces(Edges=nurbs_8.Curve)
mesh_uv_3 = MeshSurface(Surface=boundary_3, UCount=number_slider_11, VCount=number_slider_11, Overhang=True, Equalize=False)
msphere = MeshSphere(Base=PlaneXY(0, 0, 0), Radius=10, UCount=10, VCount=20)
mesh_uv_4 = MeshSurface(Surface=boundary_4, UCount=number_slider_12, VCount=number_slider_12, Overhang=True, Equalize=False)
mesh_to_graph_6 = MeshToGraph(Mesh=mesh_uv_3)
mesh_to_graph_7 = MeshToGraph(Mesh=mesh_uv_4)
mesh_to_graph_8 = MeshToGraph(Mesh=msphere)
pt_86 = Point(Point(39.87977959, 18.67332239, 0))
pt_87 = Point(Point(13.21999551, 8.355425302, 0))
pt_88 = Point(Point(11.47869486, 6.849099476, 15.28077532))
deconstruct_graph_11 = DeconstructGraph(Graph=mesh_to_graph_6)  # -> GraphArray, Vertices, Edges, AdjacencyList
deconstruct_graph_12 = DeconstructGraph(Graph=mesh_to_graph_7)  # -> GraphArray, Vertices, Edges, AdjacencyList
get_closest_vertex = GetClosestVertex(Graph=mesh_to_graph_6, Point=pt_86)
deconstruct_graph_13 = DeconstructGraph(Graph=mesh_to_graph_8)  # -> GraphArray, Vertices, Edges, AdjacencyList
get_closest_vertex_2 = GetClosestVertex(Graph=mesh_to_graph_7, Point=pt_87)
get_closest_vertex_3 = GetClosestVertex(Graph=mesh_to_graph_8, Point=pt_88)
panel_39 = Panel(get_closest_vertex)
panel_40 = Panel(get_closest_vertex_2)
item = ListItem(List=deconstruct_graph_11.Vertices, Index=get_closest_vertex, Wrap=True)
txt_39 = Text("30")
item_2 = ListItem(List=deconstruct_graph_12.Vertices, Index=get_closest_vertex_2, Wrap=True)
txt_40 = Text("14")
panel_41 = Panel(get_closest_vertex_3)
item_3 = ListItem(List=deconstruct_graph_13.Vertices, Index=get_closest_vertex_3, Wrap=True)
txt_41 = Text("143")
assert_29 = Assert(TestNames="GetClosestVertexMilimeters_XYMeshOutside_Index", Expected=txt_39, Actual=panel_39)  # -> Result, FailedInfo
assert_30 = Assert(TestNames="GetClosestVertexMilimeters_XYMesh_Index", Expected=txt_40, Actual=panel_40)  # -> Result, FailedInfo
assert_31 = Assert(TestNames="GetClosestVertexMilimeters_3dMesh_Index", Expected=txt_41, Actual=panel_41)  # -> Result, FailedInfo
entwine_16 = Entwine(Branch00=assert_30.Result, Branch01=assert_29.Result, Branch02=assert_31.Result, FlattenInputs=True)  # -> flatten(Result)

# ----
# Get Graph Degree
number_slider_13 = Slider(10, range=0..10)
pt_89 = Point(Point(10, 10, 0))
pt_90 = Point(Point(0, 10, 0))
pt_91 = Point(Point(0, 0, 0))
pt_92 = Point(Point(10, 0, 0))
face_5 = MeshFace({A=0, B=2, C=1, D=1})
face_6 = MeshFace({A=0, B=3, C=2, D=2})
toggle_7 = BooleanToggle(True)
pt_93 = ConstructPoint(XCoordinate=0, YCoordinate=0, ZCoordinate=0)
pt_94 = ConstructPoint(XCoordinate=Slider(10, range=0..10), YCoordinate=0, ZCoordinate=0)
pt_95 = ConstructPoint(XCoordinate=0, YCoordinate=0, ZCoordinate=0)
pt_96 = ConstructPoint(XCoordinate=number_slider_13, YCoordinate=0, ZCoordinate=0)
pt_97 = ConstructPoint(XCoordinate=0, YCoordinate=0, ZCoordinate=0)
pt_98 = ConstructPoint(XCoordinate=Slider(10, range=0..10), YCoordinate=0, ZCoordinate=0)
pt_99 = ConstructPoint(XCoordinate=0, YCoordinate=0, ZCoordinate=0)
pt_100 = ConstructPoint(XCoordinate=Slider(5, range=0..10), YCoordinate=Slider(5, range=0..10), ZCoordinate=0)
conmesh_4 = ConstructMesh(Vertices=[pt_91, pt_92, pt_89, pt_90], Faces=[face_5, face_6])
two_points_to_graph_part_26 = TwoPointsToGraphPart(PointA=pt_93, PointB=pt_94, IsDirected=Toggle(True))
two_points_to_graph_part_27 = TwoPointsToGraphPart(PointA=pt_95, PointB=pt_96, IsDirected=Toggle(False))
two_points_to_graph_part_28 = TwoPointsToGraphPart(PointA=pt_99, PointB=pt_100, IsDirected=toggle_7)
two_points_to_graph_part_29 = TwoPointsToGraphPart(PointA=pt_98, PointB=pt_100, IsDirected=toggle_7)
two_points_to_graph_part_30 = TwoPointsToGraphPart(PointA=pt_97, PointB=pt_98, IsDirected=toggle_7)
mesh_to_graph_9 = MeshToGraph(Mesh=conmesh_4)
create_graph_14 = CreateGraph(GraphParts=two_points_to_graph_part_26, Tolerance=0.0001)
create_graph_15 = CreateGraph(GraphParts=two_points_to_graph_part_27, Tolerance=0.0001)
create_graph_16 = CreateGraph(GraphParts=[two_points_to_graph_part_30, two_points_to_graph_part_28, two_points_to_graph_part_29], Tolerance=0.0001)
get_graph_degree = GetGraphDegree(Graph=mesh_to_graph_9)
get_graph_degree_2 = GetGraphDegree(Graph=create_graph_14)
get_graph_degree_3 = GetGraphDegree(Graph=create_graph_15)
int = Integer(6)
get_graph_degree_4 = GetGraphDegree(Graph=create_graph_16)
assert_32 = Assert(TestNames="GetGraphDegreeMilimeters_2FaceTriMesh_Degree", Expected=int, Actual=get_graph_degree)  # -> Result, FailedInfo
int_2 = Integer(2)
int_3 = Integer(1)
int_4 = Integer(2)
assert_33 = Assert(TestNames="GetGraphDegreeMilimeters_Triangle_Degree", Expected=int_2, Actual=get_graph_degree_4)  # -> Result, FailedInfo
assert_34 = Assert(TestNames="GetGraphDegreeMilimeters_1GraphPart_Degree", Expected=int_3, Actual=get_graph_degree_2)  # -> Result, FailedInfo
assert_35 = Assert(TestNames="GetGraphDegreeMilimeters_1GraphPartUndirected_Degree", Expected=int_4, Actual=get_graph_degree_3)  # -> Result, FailedInfo
entwine_17 = Entwine(
    Branch00=assert_34.Result,
    Branch01=assert_35.Result,
    Branch02=assert_33.Result,
    Branch03=assert_32.Result,
    FlattenInputs=True)  # -> flatten(Result)

# ----
# Get Vertex Degree
number_slider_14 = Slider(10, range=0..10)
pt_101 = Point(Point(10, 10, 0))
pt_102 = Point(Point(0, 10, 0))
pt_103 = Point(Point(0, 0, 0))
pt_104 = Point(Point(10, 0, 0))
face_7 = MeshFace({A=0, B=2, C=1, D=1})
face_8 = MeshFace({A=0, B=3, C=2, D=2})
pt_105 = ConstructPoint(XCoordinate=0, YCoordinate=0, ZCoordinate=0)
pt_106 = ConstructPoint(XCoordinate=number_slider_14, YCoordinate=0, ZCoordinate=0)
toggle_8 = BooleanToggle(False)
conmesh_5 = ConstructMesh(Vertices=[pt_103, pt_104, pt_101, pt_102], Faces=[face_7, face_8])
pt_107 = ConstructPoint(XCoordinate=0, YCoordinate=0, ZCoordinate=0)
pt_108 = ConstructPoint(XCoordinate=Slider(10, range=0..10), YCoordinate=0, ZCoordinate=0)
pt_109 = ConstructPoint(XCoordinate=0, YCoordinate=0, ZCoordinate=0)
pt_110 = ConstructPoint(XCoordinate=Slider(5, range=0..10), YCoordinate=Slider(5, range=0..10), ZCoordinate=0)
two_points_to_graph_part_31 = TwoPointsToGraphPart(PointA=pt_105, PointB=pt_106, IsDirected=Toggle(True))
mesh_to_graph_10 = MeshToGraph(Mesh=conmesh_5)
two_points_to_graph_part_32 = TwoPointsToGraphPart(PointA=pt_109, PointB=pt_110, IsDirected=toggle_8)
two_points_to_graph_part_33 = TwoPointsToGraphPart(PointA=pt_108, PointB=pt_110, IsDirected=toggle_8)
two_points_to_graph_part_34 = TwoPointsToGraphPart(PointA=pt_107, PointB=pt_108, IsDirected=toggle_8)
create_graph_17 = CreateGraph(GraphParts=two_points_to_graph_part_31, Tolerance=0.0001)
get_vertex_degrees = GetVertexDegrees(Graph=mesh_to_graph_10, Index="0")  # -> Degree, Indegree, Outdegree
create_graph_18 = CreateGraph(GraphParts=[two_points_to_graph_part_34, two_points_to_graph_part_32, two_points_to_graph_part_33], Tolerance=0.0001)
get_vertex_degrees_2 = GetVertexDegrees(Graph=create_graph_17, Index="0")  # -> Degree, Indegree, Outdegree
get_vertex_degrees_3 = GetVertexDegrees(Graph=create_graph_17, Index="1")  # -> Degree, Indegree, Outdegree
get_vertex_degrees_4 = GetVertexDegrees(Graph=create_graph_18, Index="0")  # -> Degree, Indegree, Outdegree
int_5 = Integer([6, 3, 3])
int_6 = Integer([1, 0, 1])
int_7 = Integer([1, 1, 0])
assert_list_18 = AssertList(
    TestName="GetVertexDegreeMilimeters_Mesh_Degrees",
    ExpectedList=int_5,
    ActualList=[get_vertex_degrees.Degree, get_vertex_degrees.Indegree, get_vertex_degrees.Outdegree])  # -> Result, FailedInfo
int_8 = Integer([4, 2, 2])
assert_list_19 = AssertList(
    TestName="GetVertexDegreeMilimeters_1GraphPartVertex0_Degrees",
    ExpectedList=int_6,
    ActualList=[get_vertex_degrees_2.Degree, get_vertex_degrees_2.Indegree, get_vertex_degrees_2.Outdegree])  # -> Result, FailedInfo
assert_list_20 = AssertList(
    TestName="GetVertexDegreeMilimeters_1GraphPartVertex1_Degrees",
    ExpectedList=int_7,
    ActualList=[get_vertex_degrees_3.Degree, get_vertex_degrees_3.Indegree, get_vertex_degrees_3.Outdegree])  # -> Result, FailedInfo
assert_list_21 = AssertList(
    TestName="GetVertexDegreeMilimeters_Triangle_Degrees",
    ExpectedList=int_8,
    ActualList=[get_vertex_degrees_4.Degree, get_vertex_degrees_4.Indegree, get_vertex_degrees_4.Outdegree])  # -> Result, FailedInfo
entwine_18 = Entwine(
    Branch00=assert_list_19.Result,
    Branch01=assert_list_20.Result,
    Branch02=assert_list_18.Result,
    Branch03=assert_list_21.Result,
    FlattenInputs=True)  # -> flatten(Result)

# ----
# BFS Is Graph Connected
number_slider_15 = Slider(50, range=0..100)
cir_2 = Circle(Plane=PlaneXY(0, 0, 0), Radius=number_slider_15)
X = UnitX(Factor=Slider(50, range=0..100))
move = Move(Geometry=cir_2, Motion=X)  # -> Geometry, Transform
toggle_9 = BooleanToggle(False)
pt_111 = Point(Point(10, 0, 0))
pt_112 = Point([Point(11.93097943, 2.333746014, 0), Point(14.26771607, 5.254666817, 0), Point(8.790989568, 7.95651856, 0), Point(6.673321986, 4.524436616, 0), Point(8.430151768, 1.423977564, 0)])
toggle_10 = BooleanToggle(False)
pt_113 = Point([Point(11.93097943, 2.333746014, 0), Point(14.26771607, 5.254666817, 0), Point(8.790989568, 7.95651856, 0), Point(6.673321986, 4.524436616, 0), Point(8.430151768, 1.423977564, 0)])
pt_114 = Point(Point(10, 0, 0))
pt_115 = Point(Point(10, 0, 0))
toggle_11 = BooleanToggle(False)
rdiff = RegionDifference(CurvesA=move.Geometry, CurvesB=cir_2)
pt_116 = Point(Point(10, 0, 0))
rdiff_2 = RegionDifference(CurvesA=cir_2, CurvesB=move.Geometry)
pt_117 = Point(Point(20, 0, 0))
pt_118 = Point(Point(10, 0, 0))
pt_119 = Point(Point(0, 0, 0))
pt_120 = Point(Point(10, 0, 0))
nurbs_9 = NurbsCurve(Vertices=[pt_120, pt_112, pt_111], Degree=3, Periodic=False)  # -> Curve, Length, Domain
pt_121 = Point(Point(0, 0, 0))
nurbs_10 = NurbsCurve(Vertices=[pt_115, pt_113, pt_114], Degree=3, Periodic=False)  # -> Curve, Length, Domain
pt_122 = Point(Point(5, 0, 0))
pt_123 = Point(Point(0, 0, 0))
boundary_5 = BoundarySurfaces(Edges=rdiff)
boundary_6 = BoundarySurfaces(Edges=rdiff_2)
two_points_to_graph_part_35 = TwoPointsToGraphPart(PointA=pt_119, PointB=pt_118, IsDirected=toggle_10)
two_points_to_graph_part_36 = TwoPointsToGraphPart(PointA=pt_117, PointB=pt_116, IsDirected=toggle_10)
cir_3 = Circle(Plane=PlaneXY(0, 0, 0), Radius=Slider(50, range=0..100))
curve_to_graph_part_6 = CurveToGraphPart(Curve=nurbs_9.Curve, IsDirected=toggle_11)
two_points_to_graph_part_37 = TwoPointsToGraphPart(PointA=pt_121, PointB=pt_120, IsDirected=toggle_11)
edges = BrepEdges(Brep=boundary_5)  # -> Naked, Interior, NonManifold
edges_2 = BrepEdges(Brep=boundary_6)  # -> Naked, Interior, NonManifold
curve_to_graph_part_7 = CurveToGraphPart(Curve=nurbs_10.Curve, IsDirected=toggle_9)
two_points_to_graph_part_38 = TwoPointsToGraphPart(PointA=pt_123, PointB=pt_122, IsDirected=toggle_9)
number_slider_16 = Slider(11, range=0..100)
panel_42 = Panel("BFSIsGraphConnecttedMilimeters_TwoPointsWithSeparateCycle_Bool")
item_4 = ListItem(List=edges.Naked, Index=0, Wrap=True)  # -> Item, Item1, Item2
item_5 = ListItem(List=edges_2.Naked, Index=0, Wrap=True)  # -> Item, Item1
boundary_7 = BoundarySurfaces(Edges=cir_3)
number_slider_17 = Slider(11, range=0..100)
create_graph_19 = CreateGraph(GraphParts=[two_points_to_graph_part_35, two_points_to_graph_part_36], Tolerance=0.0001)
join = JoinCurves(Curves=[item_5.Item1, item_4.Item1, item_4.Item], Preserve=False)
create_graph_20 = CreateGraph(GraphParts=[two_points_to_graph_part_37, curve_to_graph_part_6], Tolerance=0.0001)
X_2 = UnitX(Factor=Slider(150, range=0..150))
create_graph_21 = CreateGraph(GraphParts=[two_points_to_graph_part_38, curve_to_graph_part_7], Tolerance=0.0001)
mesh_uv_5 = MeshSurface(Surface=boundary_7, UCount=number_slider_16, VCount=number_slider_16, Overhang=True, Equalize=False)
boundary_8 = BoundarySurfaces(Edges=join)
move_2 = Move(Geometry=mesh_uv_5, Motion=X_2)  # -> Geometry, Transform
bfs_is_graph_connected = BFSIsGraphConnected(Graph=create_graph_19)
mesh_uv_6 = MeshSurface(Surface=boundary_8, UCount=number_slider_17, VCount=number_slider_17, Overhang=True, Equalize=False)
bfs_is_graph_connected_2 = BFSIsGraphConnected(Graph=create_graph_20)
mjoin = MeshJoin(Meshes=[mesh_uv_5, move_2.Geometry])
bfs_is_graph_connected_3 = BFSIsGraphConnected(Graph=create_graph_21)
mesh_to_graph_11 = MeshToGraph(Mesh=mesh_uv_6)
mesh_to_graph_12 = MeshToGraph(Mesh=mjoin)
bool_5 = Boolean(True)
bool_6 = Boolean(True)
bool_7 = Boolean(False)
bfs_is_graph_connected_4 = BFSIsGraphConnected(Graph=mesh_to_graph_11)
assert_36 = Assert(TestNames="BFSIsGraphConnecttedMilimeters_TwoPointsWithBridge_Bool", Expected=bool_5, Actual=bfs_is_graph_connected)  # -> Result, FailedInfo
assert_37 = Assert(TestNames="BFSIsGraphConnecttedMilimeters_TwoPointsWithCycle_Bool", Expected=bool_6, Actual=bfs_is_graph_connected_2)  # -> Result, FailedInfo
bfs_is_graph_connected_5 = BFSIsGraphConnected(Graph=mesh_to_graph_12)
assert_38 = Assert(TestNames=panel_42, Expected=bool_7, Actual=bfs_is_graph_connected_3)  # -> Result, FailedInfo
bool_8 = Boolean(True)
bool_9 = Boolean(False)
panel_43 = Panel(bfs_is_graph_connected_4)
assert_39 = Assert(TestNames="BFSIsGraphConnecttedMilimeters_ConnectedCircles_Bool", Expected=bool_8, Actual=bfs_is_graph_connected_4)  # -> Result, FailedInfo
panel_44 = Panel(bfs_is_graph_connected_5)
assert_40 = Assert(TestNames="BFSIsGraphConnecttedMilimeters_SeparateCircles_Bool", Expected=bool_9, Actual=bfs_is_graph_connected_5)  # -> Result, FailedInfo
entwine_19 = Entwine(
    Branch00=assert_39.Result,
    Branch01=assert_40.Result,
    Branch02=assert_36.Result,
    Branch03=assert_37.Result,
    Branch04=assert_38.Result,
    FlattenInputs=True)  # -> flatten(Result)

# ----
# BFS Search
number_slider_18 = Slider(10, range=0..10)
number_slider_19 = Slider(5, range=0..10)
pt_124 = ConstructPoint(XCoordinate=0, YCoordinate=0, ZCoordinate=0)
pt_125 = ConstructPoint(XCoordinate=number_slider_18, YCoordinate=0, ZCoordinate=0)
pt_126 = ConstructPoint(XCoordinate=0, YCoordinate=0, ZCoordinate=0)
pt_127 = ConstructPoint(XCoordinate=Slider(10, range=0..10), YCoordinate=0, ZCoordinate=0)
pt_128 = ConstructPoint(XCoordinate=0, YCoordinate=0, ZCoordinate=0)
pt_129 = ConstructPoint(XCoordinate=Slider(10, range=0..10), YCoordinate=0, ZCoordinate=0)
cir_4 = Circle(Plane=PlaneXY(0, 0, 0), Radius=Slider(50, range=0..100))
cir_5 = Circle(Plane=PlaneXY(0, 0, 0), Radius=Slider(50, range=0..100))
number_slider_20 = Slider(11, range=0..100)
number_slider_21 = Slider(11, range=0..100)
two_points_to_graph_part_39 = TwoPointsToGraphPart(PointA=pt_124, PointB=pt_125, IsDirected=Toggle(True))
two_points_to_graph_part_40 = TwoPointsToGraphPart(PointA=pt_126, PointB=pt_127, IsDirected=Toggle(True))
toggle_12 = BooleanToggle(True)
two_points_to_graph_part_41 = TwoPointsToGraphPart(PointA=pt_128, PointB=pt_129, IsDirected=Toggle(True))
panel_45 = Panel("BFSSearchMilimeters_1GraphEdgeUndirectedStart0_PreviousArray")
boundary_9 = BoundarySurfaces(Edges=cir_4)
pt_130 = ConstructPoint(XCoordinate=number_slider_19, YCoordinate=Slider(10, range=0..20), ZCoordinate=0)
pt_131 = ConstructPoint(XCoordinate=Slider(10, range=0..10), YCoordinate=0, ZCoordinate=0)
boundary_10 = BoundarySurfaces(Edges=cir_5)
pt_132 = ConstructPoint(XCoordinate=0, YCoordinate=0, ZCoordinate=0)
pt_133 = ConstructPoint(XCoordinate=0, YCoordinate=0, ZCoordinate=0)
pt_134 = ConstructPoint(XCoordinate=number_slider_19, YCoordinate=Slider(5, range=0..10), ZCoordinate=0)
X_3 = UnitX(Factor=Slider(150, range=0..150))
two_points_to_graph_part_42 = TwoPointsToGraphPart(PointA=pt_134, PointB=pt_130, IsDirected=toggle_12)
X_4 = UnitX(Factor=Slider(150, range=0..150))
two_points_to_graph_part_43 = TwoPointsToGraphPart(PointA=pt_133, PointB=pt_134, IsDirected=toggle_12)
two_points_to_graph_part_44 = TwoPointsToGraphPart(PointA=pt_131, PointB=pt_134, IsDirected=toggle_12)
two_points_to_graph_part_45 = TwoPointsToGraphPart(PointA=pt_132, PointB=pt_131, IsDirected=toggle_12)
create_graph_22 = CreateGraph(GraphParts=two_points_to_graph_part_39, Tolerance=0.0001)
mesh_uv_7 = MeshSurface(Surface=boundary_9, UCount=number_slider_20, VCount=number_slider_20, Overhang=True, Equalize=False)
mesh_uv_8 = MeshSurface(Surface=boundary_10, UCount=number_slider_21, VCount=number_slider_21, Overhang=True, Equalize=False)
create_graph_23 = CreateGraph(GraphParts=two_points_to_graph_part_40, Tolerance=0.0001)
create_graph_24 = CreateGraph(GraphParts=two_points_to_graph_part_41, Tolerance=0.0001)
move_3 = Move(Geometry=mesh_uv_7, Motion=X_3)  # -> Geometry, Transform
move_4 = Move(Geometry=mesh_uv_8, Motion=X_4)  # -> Geometry, Transform
mjoin_2 = MeshJoin(Meshes=[mesh_uv_7, move_3.Geometry])
mjoin_3 = MeshJoin(Meshes=[mesh_uv_8, move_4.Geometry])
bfs_search = BFSSearch(Graph=create_graph_22, StartVertexIndex="1", KeepSearching=Toggle(False))  # -> Visited, PreviousArray
bfs_search_2 = BFSSearch(Graph=create_graph_23, StartVertexIndex="0", KeepSearching=Toggle(False))  # -> Visited, PreviousArray
bfs_search_3 = BFSSearch(Graph=create_graph_24, StartVertexIndex="0", KeepSearching=Toggle(False))  # -> Visited, PreviousArray
create_graph_25 = CreateGraph(
    GraphParts=[two_points_to_graph_part_45, two_points_to_graph_part_43, two_points_to_graph_part_44, two_points_to_graph_part_42],
    Tolerance=0.0001)
mesh_to_graph_13 = MeshToGraph(Mesh=mjoin_2)
mesh_to_graph_14 = MeshToGraph(Mesh=mjoin_3)
bfs_search_4 = BFSSearch(Graph=create_graph_25, StartVertexIndex=0, KeepSearching=Toggle(False))  # -> Visited, PreviousArray
deconstruct_graph_14 = DeconstructGraph(Graph=create_graph_25)  # -> GraphArray, Vertices, Edges, AdjacencyList
lng_2 = ListLength(List=deconstruct_graph_14.Vertices)
series_2 = Series(Start=0, Step=1, Count=lng_2)
pt_135 = Point(Point(10, 0, 0))
txt_42 = Text(["-1", "0"])
pt_136 = Point([Point(0, 0, 0), Point(10, 0, 0)])
txt_43 = Text(["-1", "0"])
panel_46 = Panel(bfs_search.PreviousArray)
pt_137 = Point([Point(0, 0, 0), Point(10, 0, 0)])
bfs_search_5 = BFSSearch(Graph=mesh_to_graph_13, StartVertexIndex=0, KeepSearching=Toggle(False))  # -> Visited, PreviousArray
txt_44 = Text(["-1", "-1"])
bfs_search_6 = BFSSearch(Graph=mesh_to_graph_14, StartVertexIndex=0, KeepSearching=Toggle(True))  # -> Visited, PreviousArray
panel_47 = Panel(bfs_search_2.PreviousArray)
panel_48 = Panel(bfs_search_3.PreviousArray)
pt_138 = Point([Point(0, 0, 0), Point(10, 0, 0), Point(5, 5, 0), Point(5, 10, 0)])
assert_list_22 = AssertList(
    TestName="BFSSearchMilimeters_1GraphEdgeDirectedStart0_PreviousArray",
    ExpectedList=txt_43,
    ActualList=bfs_search_2.PreviousArray)  # -> Result, FailedInfo
assert_point_list_27 = AssertPointList(
    TestName="BFSSearchMilimeters_1GraphEdgeDirectedStart0_Visited",
    ExpectedPointList=pt_135,
    ActualPointList=bfs_search.Visited,
    Tolerance=Slider(0.0001, range=0..0.0001))  # -> Result, FailedInfo
assert_list_23 = AssertList(TestName=panel_45, ExpectedList=txt_42, ActualList=bfs_search_3.PreviousArray)  # -> Result, FailedInfo
assert_list_24 = AssertList(
    TestName="BFSSearchMilimeters_1GraphEdgeDirectedStart0_PreviousArray",
    ExpectedList=txt_44,
    ActualList=bfs_search.PreviousArray)  # -> Result, FailedInfo
txt_45 = Text(["-1", "0", "0", "2"])
tag_2 = TextTag3D(Location=deconstruct_graph_14.Vertices, Text=series_2, Size=1, Justification=7)
assert_point_list_28 = AssertPointList(
    TestName="BFSSearchMilimeters_1GraphEdgeDirectedStart0_Visited",
    ExpectedPointList=pt_136,
    ActualPointList=bfs_search_2.Visited,
    Tolerance=Slider(0.0001, range=0..0.0001))  # -> Result, FailedInfo
assert_point_list_29 = AssertPointList(
    TestName="BFSSearchMilimeters_1GraphEdgeUndirectedStart0_Visited",
    ExpectedPointList=pt_137,
    ActualPointList=bfs_search_3.Visited,
    Tolerance=Slider(0.0001, range=0..0.0001))  # -> Result, FailedInfo
pt_139 = Point([Point(-51, -32.45454545, 0), Point(-51, -23.18181818, 0), Point(-41.72727273, -32.45454545, 0), Point(-51, -13.90909091, 0), Point(-41.72727273, -23.18181818, 0), Point(-41.72727273, -41.72727273, 0)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])
pt_140 = Point([Point(-51, -32.45454545, 0), Point(-51, -23.18181818, 0), Point(-41.72727273, -32.45454545, 0), Point(-51, -13.90909091, 0), Point(-41.72727273, -23.18181818, 0), Point(-41.72727273, -41.72727273, 0)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])
crv_15 = Curve(deconstruct_graph_14.Edges)
assert_point_list_30 = AssertPointList(
    TestName="BFSSearchMilimeters_TriangleStart0_Visited",
    ExpectedPointList=pt_138,
    ActualPointList=bfs_search_4.Visited,
    Tolerance=Slider(0.0001, range=0..0.0001))  # -> Result, FailedInfo
assert_list_25 = AssertList(TestName="BFSSearchMilimeters_TriangleStart0_PreviousArray", ExpectedList=txt_45, ActualList=bfs_search_4.PreviousArray)  # -> Result, FailedInfo
txt_46 = Text(["-1", "0", "1", "2", "3", "4", "5", "6", "9", "0"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])
txt_47 = Text(["-1", "0", "1", "2", "3", "4", "5", "6", "9", "0"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])
assert_point_list_31 = AssertPointList(
    TestName="BFSSearchMilimeters_NotConnectedMesh_Visited",
    ExpectedPointList=pt_139,
    ActualPointList=bfs_search_5.Visited,
    Tolerance=Slider(0.0001, range=0..0.0001))  # -> Result, FailedInfo
panel_49 = Panel(bfs_search_4.PreviousArray)
assert_point_list_32 = AssertPointList(
    TestName="BFSSearchMilimeters_NotConnectedMeshKeep_Visited",
    ExpectedPointList=pt_140,
    ActualPointList=bfs_search_6.Visited,
    Tolerance=Slider(0.0001, range=0..0.0001))  # -> Result, FailedInfo
assert_list_26 = AssertList(
    TestName="BFSSearchMilimeters_NotConnectedMesh_PreviousArray",
    ExpectedList=txt_46,
    ActualList=bfs_search_5.PreviousArray)  # -> Result, FailedInfo
assert_list_27 = AssertList(
    TestName="BFSSearchMilimeters_NotConnectedMeshKeep_PreviousArray",
    ExpectedList=txt_47,
    ActualList=bfs_search_6.PreviousArray)  # -> Result, FailedInfo
entwine_20 = Entwine(
    Branch00=assert_point_list_28.Result,
    Branch01=assert_list_22.Result,
    Branch02=assert_point_list_27.Result,
    Branch03=assert_list_24.Result,
    Branch04=assert_point_list_29.Result,
    Branch05=assert_list_23.Result,
    Branch06=assert_point_list_30.Result,
    Branch07=assert_list_25.Result,
    Branch08=assert_point_list_31.Result,
    Branch09=assert_list_26.Result,
    Branch010=assert_point_list_32.Result,
    Branch011=assert_list_27.Result,
    FlattenInputs=True)  # -> flatten(Result)

# ----
# Dijkstra Search
number_slider_22 = Slider(13, range=0..100)
number_slider_23 = Slider(9, range=0..100)
number_slider_24 = Slider(5, range=0..10)
number_slider_25 = Slider(5, range=0..10)
toggle_13 = BooleanToggle(True)
pt_141 = ConstructPoint(XCoordinate=number_slider_22, YCoordinate=number_slider_22, ZCoordinate=0)
pt_142 = ConstructPoint(XCoordinate=number_slider_23, YCoordinate=number_slider_23, ZCoordinate=0)
pt_143 = ConstructPoint(XCoordinate=0, YCoordinate=0, ZCoordinate=0)
pt_144 = ConstructPoint(XCoordinate=Slider(10, range=0..10), YCoordinate=0, ZCoordinate=0)
pt_145 = ConstructPoint(XCoordinate=number_slider_24, YCoordinate=Slider(10, range=0..20), ZCoordinate=0)
pt_146 = ConstructPoint(XCoordinate=Slider(10, range=0..10), YCoordinate=0, ZCoordinate=0)
pt_147 = ConstructPoint(XCoordinate=0, YCoordinate=0, ZCoordinate=0)
pt_148 = ConstructPoint(XCoordinate=Slider(10, range=0..10), YCoordinate=0, ZCoordinate=0)
pt_149 = ConstructPoint(XCoordinate=0, YCoordinate=0, ZCoordinate=0)
pt_150 = ConstructPoint(XCoordinate=0, YCoordinate=0, ZCoordinate=0)
pt_151 = ConstructPoint(XCoordinate=number_slider_24, YCoordinate=Slider(5, range=0..10), ZCoordinate=0)
toggle_14 = BooleanToggle(True)
pt_152 = ConstructPoint(XCoordinate=number_slider_25, YCoordinate=Slider(10, range=0..20), ZCoordinate=0)
pt_153 = ConstructPoint(XCoordinate=Slider(10, range=0..10), YCoordinate=0, ZCoordinate=0)
pt_154 = ConstructPoint(XCoordinate=0, YCoordinate=0, ZCoordinate=0)
pt_155 = ConstructPoint(XCoordinate=0, YCoordinate=0, ZCoordinate=0)
pt_156 = ConstructPoint(XCoordinate=number_slider_25, YCoordinate=Slider(5, range=0..10), ZCoordinate=0)
two_points_to_graph_part_46 = TwoPointsToGraphPart(PointA=pt_143, PointB=pt_144, IsDirected=Toggle(True))
two_points_to_graph_part_47 = TwoPointsToGraphPart(PointA=pt_151, PointB=pt_145, IsDirected=toggle_13)
two_points_to_graph_part_48 = TwoPointsToGraphPart(PointA=pt_150, PointB=pt_151, IsDirected=toggle_13)
two_points_to_graph_part_49 = TwoPointsToGraphPart(PointA=pt_146, PointB=pt_151, IsDirected=toggle_13)
two_points_to_graph_part_50 = TwoPointsToGraphPart(PointA=pt_147, PointB=pt_148, IsDirected=Toggle(True))
two_points_to_graph_part_51 = TwoPointsToGraphPart(PointA=pt_149, PointB=pt_146, IsDirected=toggle_13)
two_points_to_graph_part_52 = TwoPointsToGraphPart(PointA=pt_141, PointB=pt_142, IsDirected=toggle_14)
two_points_to_graph_part_53 = TwoPointsToGraphPart(PointA=pt_155, PointB=pt_156, IsDirected=toggle_14)
two_points_to_graph_part_54 = TwoPointsToGraphPart(PointA=pt_153, PointB=pt_156, IsDirected=toggle_14)
two_points_to_graph_part_55 = TwoPointsToGraphPart(PointA=pt_154, PointB=pt_153, IsDirected=toggle_14)
panel_50 = Panel("DijkstraSearchMilimeters_1GraphEdgeDirectedStart1_WeightsArray")
panel_51 = Panel("DijkstraSearchMilimeters_1GraphEdgeDirectedStart1_PreviousArray")
panel_52 = Panel("DijkstraSearchMilimeters_1GraphEdgeDirectedStart0_WeightsArray")
panel_53 = Panel("DijkstraSearchMilimeters_1GraphEdgeDirectedStart0_PreviousArray")
create_graph_26 = CreateGraph(GraphParts=two_points_to_graph_part_46, Tolerance=0.0001)
create_graph_27 = CreateGraph(GraphParts=two_points_to_graph_part_50, Tolerance=0.0001)
create_graph_28 = CreateGraph(
    GraphParts=[two_points_to_graph_part_51, two_points_to_graph_part_48, two_points_to_graph_part_49, two_points_to_graph_part_47],
    Tolerance=0.0001)
panel_54 = Panel("DijkstraSearchMilimeters_TriangleSeparatedEdgeStart0_WeightsArray")
panel_55 = Panel("DijkstraSearchMilimeters_TriangleSeparatedEdgeStart0_PreviousArray")
panel_56 = Panel("DijkstraSearchMilimeters_TriangleSeparatedEdgeStart0_Visited")
dijkstra_search = DijkstraSearch(Graph=create_graph_26, StartVertexIndex="1")  # -> Visited, PreviousArray, WeightsArray
dijkstra_search_2 = DijkstraSearch(Graph=create_graph_27, StartVertexIndex="0")  # -> Visited, PreviousArray, WeightsArray
dijkstra_search_3 = DijkstraSearch(Graph=create_graph_28, StartVertexIndex="0")  # -> Visited, PreviousArray, WeightsArray
create_graph_29 = CreateGraph(
    GraphParts=[two_points_to_graph_part_55, two_points_to_graph_part_53, two_points_to_graph_part_54, two_points_to_graph_part_52],
    Tolerance=0.0001)
pt_157 = Point(Point(10, 0, 0))
pt_158 = Point([Point(0, 0, 0), Point(10, 0, 0)])
txt_48 = Text(["+Infinity", "0"])
txt_49 = Text(["-1", "-1"])
txt_50 = Text(["0", "10"])
txt_51 = Text(["-1", "0"])
assert_list_28 = AssertList(TestName=panel_50, ExpectedList=txt_48, ActualList=dijkstra_search.WeightsArray)  # -> Result, FailedInfo
assert_point_list_33 = AssertPointList(
    TestName="DijkstraSearchMilimeters_1GraphEdgeDirectedStart1_Visited",
    ExpectedPointList=pt_157,
    ActualPointList=dijkstra_search.Visited,
    Tolerance=Slider(0.0001, range=0..0.0001))  # -> Result, FailedInfo
assert_list_29 = AssertList(TestName=panel_51, ExpectedList=txt_49, ActualList=dijkstra_search.PreviousArray)  # -> Result, FailedInfo
assert_list_30 = AssertList(TestName=panel_52, ExpectedList=txt_50, ActualList=dijkstra_search_2.WeightsArray)  # -> Result, FailedInfo
assert_point_list_34 = AssertPointList(
    TestName="DijkstraSearchMilimeters_1GraphEdgeDirectedStart0_Visited",
    ExpectedPointList=pt_158,
    ActualPointList=dijkstra_search_2.Visited,
    Tolerance=Slider(0.0001, range=0..0.0001))  # -> Result, FailedInfo
assert_list_31 = AssertList(TestName=panel_53, ExpectedList=txt_51, ActualList=dijkstra_search_2.PreviousArray)  # -> Result, FailedInfo
pt_159 = Point([Point(0, 0, 0), Point(5, 5, 0), Point(10, 0, 0), Point(5, 10, 0)])
txt_52 = Text(["0", "10", "7.071068", "12.071068"])
txt_53 = Text(["-1", "0", "0", "2"])
dijkstra_search_4 = DijkstraSearch(Graph=create_graph_29, StartVertexIndex="0")  # -> Visited, PreviousArray, WeightsArray
assert_list_32 = AssertList(
    TestName="DijkstraSearchMilimeters_TriangleStart0_WeightsArray",
    ExpectedList=txt_52,
    ActualList=dijkstra_search_3.WeightsArray)  # -> Result, FailedInfo
assert_point_list_35 = AssertPointList(
    TestName="DijkstraSearchMilimeters_TriangleStart0_Visited",
    ExpectedPointList=pt_159,
    ActualPointList=dijkstra_search_3.Visited,
    Tolerance=Slider(0.0001, range=0..0.0001))  # -> Result, FailedInfo
assert_list_33 = AssertList(
    TestName="DijkstraSearchMilimeters_TriangleStart0_PreviousArray",
    ExpectedList=txt_53,
    ActualList=dijkstra_search_3.PreviousArray)  # -> Result, FailedInfo
pt_160 = Point([Point(0, 0, 0), Point(5, 5, 0), Point(10, 0, 0)])
txt_54 = Text(["0", "10", "7.071068", "+Infinity", "+Infinity"])
txt_55 = Text(["-1", "0", "0", "-1", "-1"])
entwine_21 = Entwine(Branch00=assert_point_list_33.Result, Branch01=assert_list_29.Result, Branch02=assert_list_28.Result, FlattenInputs=True)  # -> flatten(Result)
entwine_22 = Entwine(Branch00=assert_point_list_34.Result, Branch01=assert_list_31.Result, Branch02=assert_list_30.Result, FlattenInputs=True)  # -> flatten(Result)
assert_list_34 = AssertList(TestName=panel_54, ExpectedList=txt_54, ActualList=dijkstra_search_4.WeightsArray)  # -> Result, FailedInfo
assert_point_list_36 = AssertPointList(
    TestName=panel_56,
    ExpectedPointList=pt_160,
    ActualPointList=dijkstra_search_4.Visited,
    Tolerance=Slider(0.0001, range=0..0.0001))  # -> Result, FailedInfo
assert_list_35 = AssertList(TestName=panel_55, ExpectedList=txt_55, ActualList=dijkstra_search_4.PreviousArray)  # -> Result, FailedInfo
panel_57 = Panel(dijkstra_search_4.WeightsArray)
entwine_23 = Entwine(Branch00=assert_point_list_35.Result, Branch01=assert_list_33.Result, Branch02=assert_list_32.Result, FlattenInputs=True)  # -> flatten(Result)
entwine_24 = Entwine(Branch00=assert_point_list_36.Result, Branch01=assert_list_35.Result, Branch02=assert_list_34.Result, FlattenInputs=True)  # -> flatten(Result)
entwine_25 = Entwine(Branch00=entwine_22, Branch01=entwine_21, Branch02=entwine_23, Branch03=entwine_24, FlattenInputs=True)  # -> flatten(Result)

# ---- group: Middle Pt
pt_161 = Point(Point(-2373.037494, 76.59373595, 0))

# ---- group: End Pt
pt_162 = Point(Point(-7086.253482, -878.5005001, 0))

# ----
# BFS Shortest Path
pt_163 = Point(Point(1857.487169, 667.8807363, 0))
pt_164 = Point(Point(-987.7209054, -1513.045284, 0))
rec_2pt = Rectangle2Pt(Plane=PlaneXY(0, 0, 0), PointA=pt_164, PointB=pt_163, Radius=0)  # -> Rectangle, Length
number_slider_26 = Slider(5, range=0..10)
number_slider_27 = Slider(115, range=0..200)
pt_165 = ConstructPoint(XCoordinate=0, YCoordinate=0, ZCoordinate=0)
pt_166 = ConstructPoint(XCoordinate=Slider(10, range=0..10), YCoordinate=0, ZCoordinate=0)
boundary_11 = BoundarySurfaces(Edges=rec_2pt.Rectangle)
start_pt = Point(Point(2323.49617, 80.4593659, 0))
pt_167 = Point([Point(-1.017953798, 9.000131072, 0), Point(11.02888898, 9.000131072, 0), Point(11.02888898, 1.040234766, 0), Point(12.02587068, 1.040234766, 0), Point(12.02587068, -6.957080503, 0), Point(15.09301499, -6.957080503, 0)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])
toggle_15 = BooleanToggle(True)
number_slider_28 = Slider(118, range=0..1000)
pt_168 = ConstructPoint(XCoordinate=number_slider_26, YCoordinate=Slider(10, range=0..20), ZCoordinate=0)
mesh_uv_9 = MeshSurface(Surface=boundary_11, UCount=number_slider_27, VCount=number_slider_27, Overhang=False, Equalize=False)
pt_169 = ConstructPoint(XCoordinate=Slider(10, range=0..10), YCoordinate=0, ZCoordinate=0)
pt_170 = ConstructPoint(XCoordinate=0, YCoordinate=0, ZCoordinate=0)
pt_171 = ConstructPoint(XCoordinate=0, YCoordinate=0, ZCoordinate=0)
pt_172 = ConstructPoint(XCoordinate=number_slider_26, YCoordinate=Slider(5, range=0..10), ZCoordinate=0)
two_points_to_graph_part_56 = TwoPointsToGraphPart(PointA=pt_165, PointB=pt_166, IsDirected=Toggle(True))
pline = PolyLine(Vertices=pt_167, Closed=True)
pt_173 = Point([Point(95.16766784, -160.5831548, 0), Point(-100.6916859, -181.1556044, 0), Point(-145.7169725, 73.58864204, 0), Point(-312.513996, -114.255042, 0)])
pt_174 = Point([Point(6.529616711, -43.36252302, 0), Point(323.1289101, 156.6400322, 0), Point(185.7341702, 434.1291855, 0), Point(-177.5993761, 528.7290912, 0), Point(-288.0345346, 110.2040014, 0)])
pt_175 = Point([Point(249.5053044, -642.6485607, 0), Point(212.9099763, -99.81786157, 0), Point(-180.0994911, -309.7410809, 0), Point(-98.15031194, -118.1155256, 0), Point(-336.0199442, -26.6272055, 0), Point(-512.897363, -32.72642684, 0), Point(-403.2141018, 85.13636504, 0)])
pt_176 = Point([Point(-2346.920815, -265.5973513, 0), Point(-2495.659637, -823.3679355, 0), Point(-2040.146993, -981.4029344, 0), Point(-1408.006998, -432.9285265, 0), Point(-1640.411408, -228.4126457, 0), Point(-952.4943539, -386.4476445, 0), Point(-571.3511214, -1018.58764, 0), Point(-831.6440607, -1334.657638, 0)])
pt_177 = Point(start_pt)
pt_178 = Point([Point(1075.006962, -187.2068887, 0), Point(753.8829581, -29.11507164, 0), Point(235.1441832, 529.1466575, 0), Point(-491.0901016, 519.2659189, 0), Point(-990.0673993, 237.6648697, 0), Point(-1543.388759, -24.17470235, 0)])
pt_179 = Point([Point(239.6437385, -410.7149406, 0), Point(101.5251699, -665.7030671, 0), Point(-194.1902268, -817.9876427, 0), Point(-475.7396165, -679.8690742, 0), Point(-613.858185, -408.9441897, 0), Point(-608.5459324, -299.1576353, 0)])
pt_180 = Point([Point(2602.527565, 7.372193304, 0), Point(2534.758439, -263.7043106, 0), Point(2120.613781, -158.2856702, 0), Point(2120.613781, -7.687612471, 0)])
pt_181 = Point([Point(-2017.961267, -308.3723872, 0), Point(-948.9009801, -912.6238534, 0), Point(-1218.490096, -1210.101498, 0), Point(-1153.416861, -1990.980316, 0)])
pt_182 = Point([Point(-2681.583165, 571.0585251, 0), Point(-3313.723161, 1184.606168, 0), Point(-3936.56698, 1110.236757, 0), Point(-4522.226093, 422.3197026, 0), Point(-4838.296091, -33.19294117, 0)])
pt_183 = Point([Point(-3293.638829, 485.2123529, 0), Point(-4395.407884, 726.2243337, 0), Point(-5244.688198, 645.8870068, 0), Point(-6059.538228, 129.4327621, 0), Point(-7253.121371, 347.491221, 0)])
two_points_to_graph_part_57 = TwoPointsToGraphPart(PointA=pt_172, PointB=pt_168, IsDirected=toggle_15)
crv_16 = Curve(pline)
demesh = DeconstructMesh(Mesh=mesh_uv_9)  # -> Vertices, Faces, Colours, Normals
two_points_to_graph_part_58 = TwoPointsToGraphPart(PointA=pt_171, PointB=pt_172, IsDirected=toggle_15)
two_points_to_graph_part_59 = TwoPointsToGraphPart(PointA=pt_169, PointB=pt_172, IsDirected=toggle_15)
two_points_to_graph_part_60 = TwoPointsToGraphPart(PointA=pt_170, PointB=pt_169, IsDirected=toggle_15)
xy = XYPlane(Origin=Point(0, 0, 0))
nurbs_11 = NurbsCurve(Vertices=[start_pt, pt_175, pt_161], Degree=3, Periodic=False)  # -> Curve, Length, Domain
nurbs_12 = NurbsCurve(Vertices=[start_pt, pt_178, pt_161], Degree=3, Periodic=False)  # -> Curve, Length, Domain
nurbs_13 = NurbsCurve(Vertices=[start_pt, pt_179, pt_161], Degree=3, Periodic=False)  # -> Curve, Length, Domain
nurbs_14 = NurbsCurve(Vertices=[start_pt, pt_173, pt_161], Degree=3, Periodic=False)  # -> Curve, Length, Domain
nurbs_15 = NurbsCurve(Vertices=[start_pt, pt_174, pt_161], Degree=3, Periodic=False)  # -> Curve, Length, Domain
number_slider_29 = Slider(200, range=0..1000)
nurbs_16 = NurbsCurve(Vertices=[pt_161, pt_176, pt_162], Degree=3, Periodic=False)  # -> Curve, Length, Domain
nurbs_17 = NurbsCurve(Vertices=[pt_161, pt_181, pt_162], Degree=3, Periodic=False)  # -> Curve, Length, Domain
nurbs_18 = NurbsCurve(Vertices=[pt_161, pt_182, pt_162], Degree=3, Periodic=False)  # -> Curve, Length, Domain
nurbs_19 = NurbsCurve(Vertices=[start_pt, pt_180, pt_177], Degree=3, Periodic=False)  # -> Curve, Length, Domain
nurbs_20 = NurbsCurve(Vertices=[pt_161, pt_183, pt_162], Degree=3, Periodic=False)  # -> Curve, Length, Domain
boundary_12 = BoundarySurfaces(Edges=crv_16)
create_graph_30 = CreateGraph(GraphParts=two_points_to_graph_part_56, Tolerance=0.0001)
msphere_2 = MeshSphere(Base=xy, Radius=Slider(18226, range=0..51000), UCount=number_slider_28, VCount=number_slider_28)
preview = CustomPreview(Geometry=crv_16, Material=ColourSwatch(SwatchColor=RGB(0, 0, 0)))
lng_3 = ListLength(List=demesh.Faces)
mesh_to_graph_15 = MeshToGraph(Mesh=msphere_2)
panel_58 = Panel("BFSShortestPathMilimeters_1GraphEdgeDirectedStart0_EdgesIndexes")
panel_59 = Panel("BFSShortestPathMilimeters_1GraphEdgeDirectedStart0_VisitedVertices")
panel_60 = Panel("BFSShortestPathMilimeters_1GraphEdgeDirectedStart0_VerticesIndexes")
panel_61 = Panel("BFSShortestPathMilimeters_1GraphEdgeDirectedStart0_Vertices")
curve_to_graph_part_8 = CurveToGraphPart(
    Curve=[nurbs_15.Curve, nurbs_14.Curve, nurbs_11.Curve, nurbs_12.Curve, nurbs_13.Curve, nurbs_19.Curve, nurbs_17.Curve, nurbs_16.Curve, nurbs_18.Curve, nurbs_20.Curve],
    IsDirected=True)
pt_184 = Point(Point(-11059.8348, -11991.24039, 0))
pt_185 = Point(Point(16772.5661, -7570.092391, 2.728484105e-12))
mesh_uv_10 = MeshSurface(Surface=boundary_12, UCount=number_slider_29, VCount=number_slider_29, Overhang=True, Equalize=False)
random = Random(Range=lng_3, Number=Slider(9664, range=0..11000), Seed=2)
create_graph_31 = CreateGraph(
    GraphParts=[two_points_to_graph_part_60, two_points_to_graph_part_58, two_points_to_graph_part_59, two_points_to_graph_part_57],
    Tolerance=0.0001)
bfs_shortest_path = BFSShortestPath(Graph=create_graph_30, StartVertexIndex="0", EndVertexIndex="1")  # -> Edges, Vertices, EdgesIndexes, VerticesIndexes, VisitedVertices
mesh_to_graph_16 = MeshToGraph(Mesh=mesh_uv_10)
int_9 = Integer(random)
get_closest_vertex_index = GetClosestVertexIndex(Graph=mesh_to_graph_15, Point=[pt_184, pt_185])
pt_186 = Point(Point(2.280885499, 2.031406068, 0))
pt_187 = Point(Point(19.90434339, 8.620356542, 0))
deletef = DeleteFaces(Mesh=mesh_uv_9, Indices=int_9)
create_graph_32 = CreateGraph(GraphParts=curve_to_graph_part_8, Tolerance=0.0001)
pt_188 = Point(Point(-799.7722196, -1310.349308, 0))
pt_189 = Point(Point(1380.439883, 186.2902823, 0))
bfs_shortest_path_2 = BFSShortestPath(Graph=create_graph_31, StartVertexIndex="0", EndVertexIndex="3")  # -> Edges, Vertices, EdgesIndexes, VerticesIndexes, VisitedVertices
panel_62 = Panel("BFSShortestPathMilimeters_MeshWithDeletedFaces_EdgesIndexes")
panel_63 = Panel("BFSShortestPathMilimeters_MeshWithDeletedFaces_VisitedVertices")
panel_64 = Panel("BFSShortestPathMilimeters_MeshWithDeletedFaces_VerticesIndexes")
divide_14 = DivideCurve(Curve=bfs_shortest_path.Edges, Count=10, Kinks=False)  # -> Points, Tangents, Parameters
item_6 = ListItem(List=get_closest_vertex_index, Index=0, Wrap=True)  # -> Item, Item1
mesh = Mesh(deletef)
pt_190 = Point([Point(0, 0, 0), Point(1, 0, 0), Point(2, 0, 0), Point(3, 0, 0), Point(4, 0, 0), Point(5, 0, 0), Point(6, 0, 0), Point(7, 0, 0), Point(8, 0, 0), Point(9, 0, 0), Point(10, 0, 0)])
mesh_to_graph_17 = MeshToGraph(Mesh=mesh)
get_closest_vertex_index_2 = GetClosestVertexIndex(Graph=mesh_to_graph_17, Point=[pt_188, pt_189])
pt_191 = Point(Point(10, 0, 0))
int_10 = Integer(0)
pt_192 = Point([Point(0, 0, 0), Point(10, 0, 0)])
get_closest_vertex_4 = GetClosestVertex(Graph=mesh_to_graph_16, Point=[pt_187, pt_186])
int_11 = Integer(1)
bfs_shortest_path_3 = BFSShortestPath(Graph=create_graph_32, StartVertexIndex="0", EndVertexIndex="2")  # -> Edges, Vertices, EdgesIndexes, VerticesIndexes, VisitedVertices
bfs_shortest_path_4 = BFSShortestPath(Graph=mesh_to_graph_15, StartVertexIndex=item_6.Item, EndVertexIndex=item_6.Item1)  # -> Edges, Vertices, EdgesIndexes, VerticesIndexes, VisitedVertices
assert_point_list_37 = AssertPointList(
    TestName="BFSShortestPathMilimeters_1GraphEdgeDirectedStart0_Edges",
    ExpectedPointList=pt_190,
    ActualPointList=divide_14.Points,
    Tolerance="0.0001")  # -> Result, FailedInfo
assert_point_list_38 = AssertPointList(TestName=panel_61, ExpectedPointList=pt_191, ActualPointList=bfs_shortest_path.Vertices, Tolerance="0.0001")  # -> Result, FailedInfo
divide_15 = DivideCurve(Curve=bfs_shortest_path_2.Edges, Count=10, Kinks=False)  # -> flatten(Points), Tangents, Parameters
assert_point_list_39 = AssertPointList(TestName=panel_59, ExpectedPointList=pt_192, ActualPointList=bfs_shortest_path.VisitedVertices, Tolerance="0.0001")  # -> Result, FailedInfo
assert_list_36 = AssertList(TestName=panel_58, ExpectedList=int_10, ActualList=bfs_shortest_path.EdgesIndexes)  # -> Result, FailedInfo
assert_list_37 = AssertList(TestName=panel_60, ExpectedList=int_11, ActualList=bfs_shortest_path.VerticesIndexes)  # -> Result, FailedInfo
divide_16 = DivideCurve(Curve=bfs_shortest_path_3.Edges, Count=10, Kinks=False)  # -> flatten(Points), Tangents, Parameters
item_7 = ListItem(List=get_closest_vertex_index_2, Index=0, Wrap=True)  # -> Item, Item1
bfs_shortest_path_5 = BFSShortestPath(Graph=mesh_to_graph_17, StartVertexIndex=item_7.Item, EndVertexIndex=item_7.Item1)  # -> Edges, Vertices, EdgesIndexes, VerticesIndexes, VisitedVertices
divide_17 = DivideCurve(Curve=bfs_shortest_path_5.Edges, Count=10, Kinks=False)  # -> flatten(Points), Tangents, Parameters
item_8 = ListItem(List=get_closest_vertex_4, Index=0, Wrap=True)  # -> Item, Item1
pt_193 = Point([Point(0, 0, 0), Point(0.5, 0.5, 0), Point(1, 1, 0), Point(1.5, 1.5, 0), Point(2, 2, 0), Point(2.5, 2.5, 0), Point(3, 3, 0), Point(3.5, 3.5, 0), Point(4, 4, 0), Point(4.5, 4.5, 0), Point(5, 5, 0), Point(5, 5, 0), Point(5, 5.5, 0), Point(5, 6, 0), Point(5, 6.5, 0), Point(5, 7, 0), Point(5, 7.5, 0), Point(5, 8, 0), Point(5, 8.5, 0), Point(5, 9, 0), Point(5, 9.5, 0), Point(5, 10, 0)])
pt_194 = Point([Point(5, 5, 0), Point(5, 10, 0)])
int_12 = Integer([1, 3])
pt_195 = Point([Point(0, 0, 0), Point(10, 0, 0), Point(5, 5, 0), Point(5, 10, 0)])
int_13 = Integer([2, 3])
int_14 = Integer([0, 6])
pt_196 = Point([Point(2323.49617, 80.4593659, 0), Point(1812.886211, 54.88866949, 0), Point(1302.058795, 34.16372588, 0), Point(790.9469533, 22.96500027, 0), Point(280.9332915, 47.70461106, 0), Point(101.4958873, 432.7617311, 0)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])
pt_197 = Point([Point(-2373.037494, 76.59373595, 0), Point(-7086.253482, -878.5005001, 0)])
crv_17 = Curve(bfs_shortest_path_5.Edges)
pt_198 = Point([Point(2323.49617, 80.4593659, 0), Point(-2373.037494, 76.59373595, 0), Point(-7086.253482, -878.5005001, 0)])
assert_point_list_40 = AssertPointList(
    TestName="BFSShortestPathMilimeters_TriangleWithEdge_Edges",
    ExpectedPointList=pt_193,
    ActualPointList=divide_15.Points,
    Tolerance="0.0001")  # -> Result, FailedInfo
int_15 = Integer([1, 2])
assert_point_list_41 = AssertPointList(
    TestName="BFSShortestPathMilimeters_TriangleWithEdge_Vertices",
    ExpectedPointList=pt_194,
    ActualPointList=bfs_shortest_path_2.Vertices,
    Tolerance="0.0001")  # -> Result, FailedInfo
int_16 = Integer([2648, 2652, 2656, 2974, 3334, 3696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])
assert_point_list_42 = AssertPointList(
    TestName="BFSShortestPathMilimeters_TriangleWithEdge_VisitedVertices",
    ExpectedPointList=pt_195,
    ActualPointList=bfs_shortest_path_2.VisitedVertices,
    Tolerance="0.0001")  # -> Result, FailedInfo
assert_list_38 = AssertList(
    TestName="BFSShortestPathMilimeters_TriangleWithEdge_EdgesIndexes",
    ExpectedList=int_12,
    ActualList=bfs_shortest_path_2.EdgesIndexes)  # -> Result, FailedInfo
pt_199 = Point([Point(-12002.02839, -13716.35485, 0), Point(-11927.32592, -13778.28823, 0), Point(-11852.62344, -13840.22161, 0), Point(-11777.92097, -13902.15499, 0), Point(-11703.21849, -13964.08837, 0), Point(-11628.51601, -14026.02175, 0)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])
pt_200 = Point([Point(-11255.00363, -14335.68866, 0), Point(-10476.07534, -14914.38639, 0), Point(-9667.451471, -15450.80768, 0), Point(-8831.424163, -15943.43198, 0), Point(-7970.363223, -16390.86288, 0), Point(-7086.709422, -16791.83211, 0)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])
int_17 = Integer([27914, 27918, 27922, 27926, 27930, 27934, 27938, 27942, 27946, 27950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])
assert_list_39 = AssertList(
    TestName="BFSShortestPathMilimeters_TriangleWithEdge_VerticesIndexes",
    ExpectedList=int_13,
    ActualList=bfs_shortest_path_2.VerticesIndexes)  # -> Result, FailedInfo
pt_201 = Point([Point(-12002.02839, -13716.35485, 0), Point(-11997.77501, -13711.49393, -485.1856237), Point(-12715.0321, -13058.14055, 0), Point(-11255.00363, -14335.68866, 0), Point(-11997.77501, -13711.49393, 485.1856237), Point(-11985.01787, -13696.9146, -970.0273587)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])
pt_202 = Point([Point(-789.7933872, -1304.434969, 0), Point(-789.7933872, -1302.538512, 0), Point(-789.7933872, -1300.642054, 0), Point(-789.7933872, -1298.745597, 0), Point(-789.7933872, -1296.84914, 0), Point(-789.7933872, -1294.952682, 0)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])
pt_203 = Point([Point(-789.7933872, -1285.470395, 0), Point(-789.7933872, -1266.505821, 0), Point(-765.0524474, -1266.505821, 0), Point(-740.3115076, -1266.505821, 0), Point(-715.5705678, -1266.505821, 0), Point(-690.8296281, -1266.505821, 0)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])
bfs_shortest_path_6 = BFSShortestPath(Graph=mesh_to_graph_16, StartVertexIndex=item_8.Item, EndVertexIndex=item_8.Item1)  # -> Edges, Vertices, EdgesIndexes, VerticesIndexes, VisitedVertices
int_18 = Integer([6921, 6922, 6923, 6924, 6925, 6926, 6927, 6928, 6929, 6930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])
pt_204 = Point([Point(-789.7933872, -1304.434969, 0), Point(-814.5343269, -1304.434969, 0), Point(-789.7933872, -1323.399543, 0), Point(-789.7933872, -1285.470395, 0), Point(-765.0524474, -1304.434969, 0), Point(-839.2752667, -1304.434969, 0)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])
assert_point_list_43 = AssertPointList(
    TestName="BFSShortestPathMilimeters_ManyEdges_Edges",
    ExpectedPointList=pt_196,
    ActualPointList=divide_16.Points,
    Tolerance="0.0001")  # -> Result, FailedInfo
int_19 = Integer([838, 839, 945, 1052, 1164, 1273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])
assert_point_list_44 = AssertPointList(
    TestName="BFSShortestPathMilimeters_ManyEdges_Vertices",
    ExpectedPointList=pt_197,
    ActualPointList=bfs_shortest_path_3.Vertices,
    Tolerance="0.0001")  # -> Result, FailedInfo
crv_18 = Curve(bfs_shortest_path_4.Edges)
divide_18 = DivideCurve(Curve=crv_18, Count=10, Kinks=False)  # -> flatten(Points), Tangents, Parameters
assert_point_list_45 = AssertPointList(
    TestName="BFSShortestPathMilimeters_ManyEdges_VisitedVertices",
    ExpectedPointList=pt_198,
    ActualPointList=bfs_shortest_path_3.VisitedVertices,
    Tolerance="0.0001")  # -> Result, FailedInfo
assert_list_40 = AssertList(
    TestName="BFSShortestPathMilimeters_ManyEdges_EdgesIndexes",
    ExpectedList=int_14,
    ActualList=bfs_shortest_path_3.EdgesIndexes)  # -> Result, FailedInfo
assert_list_41 = AssertList(
    TestName="BFSShortestPathMilimeters_ManyEdges_VerticesIndexes",
    ExpectedList=int_15,
    ActualList=bfs_shortest_path_3.VerticesIndexes)  # -> Result, FailedInfo
crv_19 = Curve(bfs_shortest_path_3.Edges)
entwine_26 = Entwine(
    Branch00=assert_point_list_37.Result,
    Branch01=assert_point_list_38.Result,
    Branch02=assert_list_36.Result,
    Branch03=assert_list_37.Result,
    Branch04=assert_point_list_39.Result,
    FlattenInputs=True)  # -> flatten(Result)
assert_point_list_46 = AssertPointList(
    TestName="BFSShortestPathMilimeters_Sphere_Edges",
    ExpectedPointList=pt_199,
    ActualPointList=divide_18.Points,
    Tolerance="0.0001")  # -> Result, FailedInfo
assert_point_list_47 = AssertPointList(
    TestName="BFSShortestPathMilimeters_Sphere_Vertices",
    ExpectedPointList=pt_200,
    ActualPointList=bfs_shortest_path_4.Vertices,
    Tolerance="0.0001")  # -> Result, FailedInfo
divide_19 = DivideCurve(Curve=bfs_shortest_path_6.Edges, Count=10, Kinks=False)  # -> flatten(Points), Tangents, Parameters
assert_point_list_48 = AssertPointList(
    TestName="BFSShortestPathMilimeters_MeshWithDeletedFaces_Edges",
    ExpectedPointList=pt_202,
    ActualPointList=divide_17.Points,
    Tolerance="0.0001")  # -> Result, FailedInfo
assert_point_list_49 = AssertPointList(
    TestName="BFSShortestPathMilimeters_Sphere_VisitedVertices",
    ExpectedPointList=pt_201,
    ActualPointList=bfs_shortest_path_4.VisitedVertices,
    Tolerance="0.0001")  # -> Result, FailedInfo
assert_point_list_50 = AssertPointList(
    TestName="BFSShortestPathMilimeters_MeshWithDeletedFaces_Vertices",
    ExpectedPointList=pt_203,
    ActualPointList=bfs_shortest_path_5.Vertices,
    Tolerance="0.0001")  # -> Result, FailedInfo
assert_list_42 = AssertList(
    TestName="BFSShortestPathMilimeters_Sphere_EdgesIndexes",
    ExpectedList=int_17,
    ActualList=bfs_shortest_path_4.EdgesIndexes)  # -> Result, FailedInfo
assert_list_43 = AssertList(
    TestName="BFSShortestPathMilimeters_Sphere_VerticesIndexes",
    ExpectedList=int_18,
    ActualList=bfs_shortest_path_4.VerticesIndexes)  # -> Result, FailedInfo
assert_point_list_51 = AssertPointList(TestName=panel_63, ExpectedPointList=pt_204, ActualPointList=bfs_shortest_path_5.VisitedVertices, Tolerance="0.0001")  # -> Result, FailedInfo
assert_list_44 = AssertList(TestName=panel_62, ExpectedList=int_16, ActualList=bfs_shortest_path_5.EdgesIndexes)  # -> Result, FailedInfo
assert_list_45 = AssertList(TestName=panel_64, ExpectedList=int_19, ActualList=bfs_shortest_path_5.VerticesIndexes)  # -> Result, FailedInfo
int_20 = Integer([77289, 76533, 75777, 75021, 74265, 73509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])
pt_205 = Point([Point(19.91742297, 8.642701002, 0), Point(19.90310266, 8.642701002, 0), Point(19.88878236, 8.642701002, 0), Point(19.87446205, 8.642701002, 0), Point(19.86014174, 8.642701002, 0), Point(19.84582144, 8.642701002, 0)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])
pt_206 = Point([Point(19.77421991, 8.642701002, 0), Point(19.63101684, 8.642701002, 0), Point(19.48781378, 8.642701002, 0), Point(19.34461072, 8.642701002, 0), Point(19.20140766, 8.642701002, 0), Point(19.0582046, 8.642701002, 0)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])
pt_207 = Point([Point(19.91742297, 8.642701002, 0), Point(19.77421991, 8.642701002, 0), Point(19.91742297, 8.545462252, 0), Point(19.91742297, 8.739939752, 0), Point(20.06062603, 8.642701002, 0), Point(19.63101684, 8.642701002, 0)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])
int_21 = Integer([20196, 20006, 19816, 19626, 19436, 19246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])
entwine_27 = Entwine(
    Branch00=assert_point_list_40.Result,
    Branch01=assert_point_list_41.Result,
    Branch02=assert_list_38.Result,
    Branch03=assert_list_39.Result,
    Branch04=assert_point_list_42.Result,
    FlattenInputs=True)  # -> flatten(Result)
assert_point_list_52 = AssertPointList(
    TestName="BFSShortestPathMilimeters_Maze_Edges",
    ExpectedPointList=pt_205,
    ActualPointList=divide_19.Points,
    Tolerance="0.0001")  # -> Result, FailedInfo
assert_point_list_53 = AssertPointList(
    TestName="BFSShortestPathMilimeters_Maze_Vertices",
    ExpectedPointList=pt_206,
    ActualPointList=bfs_shortest_path_6.Vertices,
    Tolerance="0.0001")  # -> Result, FailedInfo
assert_point_list_54 = AssertPointList(
    TestName="BFSShortestPathMilimeters_Maze_VisitedVertices",
    ExpectedPointList=pt_207,
    ActualPointList=bfs_shortest_path_6.VisitedVertices,
    Tolerance="0.0001")  # -> Result, FailedInfo
assert_list_46 = AssertList(TestName="BFSShortestPathMilimeters_Maze_EdgesIndexes", ExpectedList=int_20, ActualList=bfs_shortest_path_6.EdgesIndexes)  # -> Result, FailedInfo
assert_list_47 = AssertList(
    TestName="BFSShortestPathMilimeters_Maze_VerticesIndexes",
    ExpectedList=int_21,
    ActualList=bfs_shortest_path_6.VerticesIndexes)  # -> Result, FailedInfo
entwine_28 = Entwine(
    Branch00=assert_point_list_43.Result,
    Branch01=assert_point_list_44.Result,
    Branch02=assert_list_40.Result,
    Branch03=assert_list_41.Result,
    Branch04=assert_point_list_45.Result,
    FlattenInputs=True)  # -> flatten(Result)
crv_20 = Curve(bfs_shortest_path_6.Edges)
entwine_29 = Entwine(
    Branch00=assert_point_list_46.Result,
    Branch01=assert_point_list_47.Result,
    Branch02=assert_list_42.Result,
    Branch03=assert_list_43.Result,
    Branch04=assert_point_list_49.Result,
    FlattenInputs=True)  # -> flatten(Result)
entwine_30 = Entwine(
    Branch00=assert_point_list_48.Result,
    Branch01=assert_point_list_50.Result,
    Branch02=assert_list_44.Result,
    Branch03=assert_list_45.Result,
    Branch04=assert_point_list_51.Result,
    FlattenInputs=True)  # -> flatten(Result)
entwine_31 = Entwine(
    Branch00=assert_point_list_52.Result,
    Branch01=assert_point_list_53.Result,
    Branch02=assert_list_46.Result,
    Branch03=assert_list_47.Result,
    Branch04=assert_point_list_54.Result,
    FlattenInputs=True)  # -> flatten(Result)
entwine_32 = Entwine(
    Branch00=entwine_26,
    Branch01=entwine_27,
    Branch02=entwine_30,
    Branch03=entwine_28,
    Branch04=entwine_31,
    Branch05=entwine_29,
    FlattenInputs=True)  # -> flatten(Result)

pt_208 = ConstructPoint(XCoordinate=0, YCoordinate=0, ZCoordinate=0)
pt_209 = ConstructPoint(XCoordinate=Slider(10, range=0..10), YCoordinate=0, ZCoordinate=0)
pt_210 = ConstructPoint(XCoordinate=0, YCoordinate=0, ZCoordinate=0)
pt_211 = ConstructPoint(XCoordinate=Slider(10, range=0..10), YCoordinate=0, ZCoordinate=0)
two_points_to_graph_part_61 = TwoPointsToGraphPart(PointA=pt_208, PointB=pt_209, IsDirected=Toggle(False))
two_points_to_graph_part_62 = TwoPointsToGraphPart(PointA=pt_210, PointB=pt_211, IsDirected=Toggle(True))
create_graph_33 = CreateGraph(GraphParts=two_points_to_graph_part_61, Tolerance=0.0001)
create_graph_34 = CreateGraph(GraphParts=two_points_to_graph_part_62, Tolerance=0.0001)
bfs_shortest_path_7 = BFSShortestPath(Graph=create_graph_33, StartVertexIndex="1", EndVertexIndex="1")  # -> Edges, Vertices, EdgesIndexes, VerticesIndexes, VisitedVertices
bfs_shortest_path_8 = BFSShortestPath(Graph=create_graph_34, StartVertexIndex="1", EndVertexIndex="0")  # -> Edges, Vertices, EdgesIndexes, VerticesIndexes, VisitedVertices

# ---- group: Middle Pt
pt_212 = Point(Point(-2373.037494, 76.59373595, 0))

# ---- group: End Pt
pt_213 = Point(Point(-7086.253482, -878.5005001, 0))

# ----
# Dijkstra Shortest Path
pt_214 = Point(Point(1857.487169, 667.8807363, 0))
pt_215 = Point(Point(-987.7209054, -1513.045284, 0))
rec_2pt_2 = Rectangle2Pt(Plane=PlaneXY(0, 0, 0), PointA=pt_215, PointB=pt_214, Radius=0)  # -> Rectangle, Length
number_slider_30 = Slider(5, range=0..10)
number_slider_31 = Slider(115, range=0..200)
number_slider_32 = Slider(1000, range=0..1000)
pt_216 = ConstructPoint(XCoordinate=0, YCoordinate=0, ZCoordinate=0)
pt_217 = ConstructPoint(XCoordinate=Slider(10, range=0..10), YCoordinate=0, ZCoordinate=0)
boundary_13 = BoundarySurfaces(Edges=rec_2pt_2.Rectangle)
number_slider_33 = Slider(118, range=0..1000)
pt_218 = Point(Point(0, 0, 0))
start_pt_2 = Point(Point(2323.49617, 80.4593659, 0))
Z = UnitZ(Factor=Slider(2000, range=0..2000))
toggle_16 = BooleanToggle(True)
number_slider_34 = Slider(400, range=0..400)
xy_2 = XYPlane(Origin=pt_218)
pt_219 = ConstructPoint(XCoordinate=number_slider_30, YCoordinate=Slider(10, range=0..20), ZCoordinate=0)
mesh_uv_11 = MeshSurface(Surface=boundary_13, UCount=number_slider_31, VCount=number_slider_31, Overhang=False, Equalize=False)
pt_220 = ConstructPoint(XCoordinate=Slider(10, range=0..10), YCoordinate=0, ZCoordinate=0)
pt_221 = ConstructPoint(XCoordinate=0, YCoordinate=0, ZCoordinate=0)
pt_222 = ConstructPoint(XCoordinate=0, YCoordinate=0, ZCoordinate=0)
pt_223 = ConstructPoint(XCoordinate=number_slider_30, YCoordinate=Slider(5, range=0..10), ZCoordinate=0)
two_points_to_graph_part_63 = TwoPointsToGraphPart(PointA=pt_216, PointB=pt_217, IsDirected=Toggle(True))
xy_3 = XYPlane(Origin=Point(0, 0, 0))
move_5 = Move(Geometry=pt_218, Motion=Z)  # -> Geometry, Transform
pt_224 = Point([Point(95.16766784, -160.5831548, 0), Point(-100.6916859, -181.1556044, 0), Point(-145.7169725, 73.58864204, 0), Point(-312.513996, -114.255042, 0)])
pt_225 = Point([Point(6.529616711, -43.36252302, 0), Point(323.1289101, 156.6400322, 0), Point(185.7341702, 434.1291855, 0), Point(-177.5993761, 528.7290912, 0), Point(-288.0345346, 110.2040014, 0)])
pt_226 = Point([Point(249.5053044, -642.6485607, 0), Point(212.9099763, -99.81786157, 0), Point(-180.0994911, -309.7410809, 0), Point(-98.15031194, -118.1155256, 0), Point(-336.0199442, -26.6272055, 0), Point(-512.897363, -32.72642684, 0), Point(-403.2141018, 85.13636504, 0)])
pt_227 = Point([Point(-2346.920815, -265.5973513, 0), Point(-2495.659637, -823.3679355, 0), Point(-2040.146993, -981.4029344, 0), Point(-1408.006998, -432.9285265, 0), Point(-1640.411408, -228.4126457, 0), Point(-952.4943539, -386.4476445, 0), Point(-571.3511214, -1018.58764, 0), Point(-831.6440607, -1334.657638, 0)])
pt_228 = Point([Point(1075.006962, -187.2068887, 0), Point(753.8829581, -29.11507164, 0), Point(235.1441832, 529.1466575, 0), Point(-491.0901016, 519.2659189, 0), Point(-990.0673993, 237.6648697, 0), Point(-1543.388759, -24.17470235, 0)])
pt_229 = Point(start_pt_2)
pt_230 = Point([Point(2602.527565, 7.372193304, 0), Point(2534.758439, -263.7043106, 0), Point(2120.613781, -158.2856702, 0), Point(2120.613781, -7.687612471, 0)])
pt_231 = Point([Point(239.6437385, -410.7149406, 0), Point(101.5251699, -665.7030671, 0), Point(-194.1902268, -817.9876427, 0), Point(-475.7396165, -679.8690742, 0), Point(-613.858185, -408.9441897, 0), Point(-608.5459324, -299.1576353, 0)])
pt_232 = Point([Point(-2017.961267, -308.3723872, 0), Point(-948.9009801, -912.6238534, 0), Point(-1218.490096, -1210.101498, 0), Point(-1153.416861, -1990.980316, 0)])
pt_233 = Point([Point(-2681.583165, 571.0585251, 0), Point(-3313.723161, 1184.606168, 0), Point(-3936.56698, 1110.236757, 0), Point(-4522.226093, 422.3197026, 0), Point(-4838.296091, -33.19294117, 0)])
pt_234 = Point([Point(-3293.638829, 485.2123529, 0), Point(-4395.407884, 726.2243337, 0), Point(-5244.688198, 645.8870068, 0), Point(-6059.538228, 129.4327621, 0), Point(-7253.121371, 347.491221, 0)])
box = CenterBox(Base=xy_2, X=number_slider_32, Y=number_slider_32, Z=number_slider_32)
two_points_to_graph_part_64 = TwoPointsToGraphPart(PointA=pt_223, PointB=pt_219, IsDirected=toggle_16)
demesh_2 = DeconstructMesh(Mesh=mesh_uv_11)  # -> Vertices, Faces, Colours, Normals
msphere_3 = MeshSphere(Base=xy_3, Radius=Slider(18226, range=0..51000), UCount=number_slider_33, VCount=number_slider_33)
two_points_to_graph_part_65 = TwoPointsToGraphPart(PointA=pt_222, PointB=pt_223, IsDirected=toggle_16)
two_points_to_graph_part_66 = TwoPointsToGraphPart(PointA=pt_220, PointB=pt_223, IsDirected=toggle_16)
two_points_to_graph_part_67 = TwoPointsToGraphPart(PointA=pt_221, PointB=pt_220, IsDirected=toggle_16)
nurbs_21 = NurbsCurve(Vertices=[start_pt_2, pt_226, pt_212], Degree=3, Periodic=False)  # -> Curve, Length, Domain
nurbs_22 = NurbsCurve(Vertices=[start_pt_2, pt_228, pt_212], Degree=3, Periodic=False)  # -> Curve, Length, Domain
nurbs_23 = NurbsCurve(Vertices=[start_pt_2, pt_231, pt_212], Degree=3, Periodic=False)  # -> Curve, Length, Domain
nurbs_24 = NurbsCurve(Vertices=[start_pt_2, pt_224, pt_212], Degree=3, Periodic=False)  # -> Curve, Length, Domain
nurbs_25 = NurbsCurve(Vertices=[start_pt_2, pt_225, pt_212], Degree=3, Periodic=False)  # -> Curve, Length, Domain
nurbs_26 = NurbsCurve(Vertices=[pt_212, pt_227, pt_213], Degree=3, Periodic=False)  # -> Curve, Length, Domain
nurbs_27 = NurbsCurve(Vertices=[pt_212, pt_232, pt_213], Degree=3, Periodic=False)  # -> Curve, Length, Domain
nurbs_28 = NurbsCurve(Vertices=[pt_212, pt_233, pt_213], Degree=3, Periodic=False)  # -> Curve, Length, Domain
nurbs_29 = NurbsCurve(Vertices=[start_pt_2, pt_230, pt_229], Degree=3, Periodic=False)  # -> Curve, Length, Domain
nurbs_30 = NurbsCurve(Vertices=[pt_212, pt_234, pt_213], Degree=3, Periodic=False)  # -> Curve, Length, Domain
pop3d = Populate3D(Region=box, Count=number_slider_34, Seed=1)
create_graph_35 = CreateGraph(GraphParts=two_points_to_graph_part_63, Tolerance=0.0001)
mesh_to_graph_18 = MeshToGraph(Mesh=msphere_3)
pt_235 = Point(Point(16772.5661, -7570.092391, 2.728484105e-12))
pt_236 = Point(Point(-11059.8348, -11991.24039, 0))
panel_65 = Panel("DijkstraShortestPathMilimeters_1GraphEdgeDirectedStart0_EdgesIndexes")
panel_66 = Panel("DijkstraShortestPathMilimeters_1GraphEdgeDirectedStart0_VisitedVertices")
panel_67 = Panel("DijkstraShortestPathMilimeters_1GraphEdgeDirectedStart0_Vertices")
panel_68 = Panel("DijkstraShortestPathMilimeters_1GraphEdgeDirectedStart0_VerticesIndexes")
lng_4 = ListLength(List=demesh_2.Faces)
voronoi³ = Voronoi3D(Points=pop3d)  # -> Cells, Boundary
panel_69 = Panel("DijkstraShortestPathMilimeters_1GraphEdgeDirectedStart0_Edges")
curve_to_graph_part_9 = CurveToGraphPart(
    Curve=[nurbs_25.Curve, nurbs_24.Curve, nurbs_21.Curve, nurbs_22.Curve, nurbs_23.Curve, nurbs_29.Curve, nurbs_27.Curve, nurbs_26.Curve, nurbs_28.Curve, nurbs_30.Curve],
    IsDirected=True)
random_2 = Random(Range=lng_4, Number=Slider(9664, range=0..11000), Seed=2)
get_closest_vertex_index_3 = GetClosestVertexIndex(Graph=mesh_to_graph_18, Point=[pt_236, pt_235])
create_graph_36 = CreateGraph(
    GraphParts=[two_points_to_graph_part_67, two_points_to_graph_part_65, two_points_to_graph_part_66, two_points_to_graph_part_64],
    Tolerance=0.0001)
dom = ConstructDomain(DomainStart=0, DomainEnd=number_slider_34)
debrep = DeconstructBrep(Brep=voronoi³.Cells)  # -> Faces, Edges, Vertices
dijkstra_shortest_path = DijkstraShortestPath(Graph=create_graph_35, StartVertexIndex="0", EndVertexIndex="1")  # -> Edges, Vertices, EdgesIndexes, VerticesIndexes, VisitedVertices
int_22 = Integer(random_2)
curve_to_graph_part_10 = CurveToGraphPart(Curve=debrep.Edges, IsDirected=False)  # -> flatten(GraphPart)
panel_70 = Panel("DijkstraShortestPathMilimeters_TriangleWithEdge_EdgesIndexes")
panel_71 = Panel("DijkstraShortestPathMilimeters_TriangleWithEdge_VisitedVertices")
panel_72 = Panel("DijkstraShortestPathMilimeters_TriangleWithEdge_VerticesIndexes")
random_3 = Random(Range=dom, Number=2, Seed=Slider(53, range=0..110), Integers=True)
deletef_2 = DeleteFaces(Mesh=mesh_uv_11, Indices=int_22)
create_graph_37 = CreateGraph(GraphParts=curve_to_graph_part_9, Tolerance=0.0001)
item_9 = ListItem(List=get_closest_vertex_index_3, Index=0, Wrap=True)  # -> Item, Item1
crv_21 = Curve(debrep.Edges)
pt_237 = Point(Point(-799.7722196, -1310.349308, 0))
pt_238 = Point(Point(1380.439883, 186.2902823, 0))
item_10 = ListItem(List=random_3, Index=0, Wrap=True)  # -> Item, Item1
dijkstra_shortest_path_2 = DijkstraShortestPath(Graph=create_graph_36, StartVertexIndex="0", EndVertexIndex="3")  # -> Edges, Vertices, EdgesIndexes, VerticesIndexes, VisitedVertices
panel_73 = Panel("DijkstraShortestPathMilimeters_MeshWithDeletedFaces_EdgesIndexes")
panel_74 = Panel("DijkstraShortestPathMilimeters_MeshWithDeletedFaces_VisitedVertices")
panel_75 = Panel("DijkstraShortestPathMilimeters_MeshWithDeletedFaces_Vertices")
panel_76 = Panel("DijkstraShortestPathMilimeters_MeshWithDeletedFaces_VerticesIndexes")
divide_20 = DivideCurve(Curve=dijkstra_shortest_path.Edges, Count=10, Kinks=False)  # -> Points, Tangents, Parameters
mesh_2 = Mesh(deletef_2)
create_graph_38 = CreateGraph(GraphParts=curve_to_graph_part_10, Tolerance=0.0001)
dijkstra_shortest_path_3 = DijkstraShortestPath(Graph=create_graph_38, StartVertexIndex=item_10.Item, EndVertexIndex=item_10.Item1)  # -> Edges, Vertices, EdgesIndexes, VerticesIndexes, VisitedVertices
dijkstra_shortest_path_4 = DijkstraShortestPath(Graph=mesh_to_graph_18, StartVertexIndex=item_9.Item, EndVertexIndex=item_9.Item1)  # -> Edges, Vertices, EdgesIndexes, VerticesIndexes, VisitedVertices
pt_239 = Point([Point(0, 0, 0), Point(1, 0, 0), Point(2, 0, 0), Point(3, 0, 0), Point(4, 0, 0), Point(5, 0, 0), Point(6, 0, 0), Point(7, 0, 0), Point(8, 0, 0), Point(9, 0, 0), Point(10, 0, 0)])
mesh_to_graph_19 = MeshToGraph(Mesh=mesh_2)
get_closest_vertex_index_4 = GetClosestVertexIndex(Graph=mesh_to_graph_19, Point=[pt_237, pt_238])
pt_240 = Point(Point(10, 0, 0))
int_23 = Integer(0)
pt_241 = Point([Point(0, 0, 0), Point(10, 0, 0)])
int_24 = Integer(1)
dijkstra_shortest_path_5 = DijkstraShortestPath(Graph=create_graph_37, StartVertexIndex="0", EndVertexIndex="2")  # -> Edges, Vertices, EdgesIndexes, VerticesIndexes, VisitedVertices
preview_2 = CustomPreview(Geometry=crv_21, Material=ColourSwatch(SwatchColor=RGB(105, 227, 255)))
divide_21 = DivideCurve(Curve=dijkstra_shortest_path_3.Edges, Count=10, Kinks=False)  # -> flatten(Points), Tangents, Parameters
assert_point_list_55 = AssertPointList(TestName=panel_69, ExpectedPointList=pt_239, ActualPointList=divide_20.Points, Tolerance="0.0001")  # -> Result, FailedInfo
assert_point_list_56 = AssertPointList(TestName=panel_67, ExpectedPointList=pt_240, ActualPointList=dijkstra_shortest_path.Vertices, Tolerance="0.0001")  # -> Result, FailedInfo
divide_22 = DivideCurve(Curve=dijkstra_shortest_path_2.Edges, Count=10, Kinks=False)  # -> flatten(Points), Tangents, Parameters
divide_23 = DivideCurve(Curve=dijkstra_shortest_path_4.Edges, Count=10, Kinks=False)  # -> flatten(Points), Tangents, Parameters
assert_point_list_57 = AssertPointList(TestName=panel_66, ExpectedPointList=pt_241, ActualPointList=dijkstra_shortest_path.VisitedVertices, Tolerance="0.0001")  # -> Result, FailedInfo
assert_list_48 = AssertList(TestName=panel_65, ExpectedList=int_23, ActualList=dijkstra_shortest_path.EdgesIndexes)  # -> Result, FailedInfo
assert_list_49 = AssertList(TestName=panel_68, ExpectedList=int_24, ActualList=dijkstra_shortest_path.VerticesIndexes)  # -> Result, FailedInfo
divide_24 = DivideCurve(Curve=dijkstra_shortest_path_5.Edges, Count=10, Kinks=False)  # -> flatten(Points), Tangents, Parameters
item_11 = ListItem(List=get_closest_vertex_index_4, Index=0, Wrap=True)  # -> Item, Item1
dijkstra_shortest_path_6 = DijkstraShortestPath(Graph=mesh_to_graph_19, StartVertexIndex=item_11.Item, EndVertexIndex=item_11.Item1)  # -> Edges, Vertices, EdgesIndexes, VerticesIndexes, VisitedVertices
pt_242 = Point([Point(-280.0025859, 337.3169172, 963.3168942), Point(-279.7861888, 330.2955051, 940.3064447), Point(-279.5697917, 323.274093, 917.2959952), Point(-279.3533946, 316.2526809, 894.2855457), Point(-279.1369975, 309.2312688, 871.2750962), Point(-278.9206005, 302.2098567, 848.2646467)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])
divide_25 = DivideCurve(Curve=dijkstra_shortest_path_6.Edges, Count=10, Kinks=False)  # -> flatten(Points), Tangents, Parameters
pt_243 = Point([Point(-277.838615, 267.1027963, 733.2123992), Point(-75.80244862, 162.0977605, 652.2820899), Point(-85.26860437, 135.1740462, 650.1466686), Point(-117.4324927, 51.95421602, 636.6293679), Point(-46.63892985, -73.33844735, 581.2467293), Point(59.31378687, -112.0571232, 539.426991)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])
int_25 = Integer([479, 466, 17371, 14512, 8620, 17316, 24074, 1777, 1804, 1766, 8891, 15304, 4139, 18330, 4115, 16516, 18329, 5832, 12217, 12215, 12250])
pt_244 = Point([Point(0, 0, 0), Point(0.5, 0.5, 0), Point(1, 1, 0), Point(1.5, 1.5, 0), Point(2, 2, 0), Point(2.5, 2.5, 0), Point(3, 3, 0), Point(3.5, 3.5, 0), Point(4, 4, 0), Point(4.5, 4.5, 0), Point(5, 5, 0), Point(5, 5, 0), Point(5, 5.5, 0), Point(5, 6, 0), Point(5, 6.5, 0), Point(5, 7, 0), Point(5, 7.5, 0), Point(5, 8, 0), Point(5, 8.5, 0), Point(5, 9, 0), Point(5, 9.5, 0), Point(5, 10, 0)])
pt_245 = Point([Point(-280.0025859, 337.3169172, 963.3168942), Point(-300.5473238, 329.1491108, 998.9444464), Point(-255.1498736, 338.1382464, 998.9444464), Point(-227.0420787, 363.8398265, 998.9444464), Point(-211.1434072, 320.5794052, 998.9444464), Point(-204.8594816, 315.3419594, 998.9444464)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])
pt_246 = Point([Point(-12002.02839, -13716.35485, 0), Point(-11927.32592, -13778.28823, 0), Point(-11852.62344, -13840.22161, 0), Point(-11777.92097, -13902.15499, 0), Point(-11703.21849, -13964.08837, 0), Point(-11628.51601, -14026.02175, 0)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])
pt_247 = Point([Point(5, 5, 0), Point(5, 10, 0)])
int_26 = Integer([1, 3])
pt_248 = Point([Point(-11255.00363, -14335.68866, 0), Point(-10476.07534, -14914.38639, 0), Point(-9667.451471, -15450.80768, 0), Point(-8831.424163, -15943.43198, 0), Point(-7970.363223, -16390.86288, 0), Point(-7086.709422, -16791.83211, 0)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])
int_27 = Integer([27914, 27918, 27922, 27926, 27930, 27934, 27938, 27942, 27946, 27950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])
pt_249 = Point([Point(0, 0, 0), Point(5, 5, 0), Point(10, 0, 0), Point(5, 10, 0)])
int_28 = Integer([159, 160, 164, 2025, 2026, 2024, 593, 598, 592, 591, 2054, 1321, 1316, 1318, 1319, 1677, 1676, 1685, 2098, 2101, 147])
pt_250 = Point(dijkstra_shortest_path_4.VisitedVertices)
int_29 = Integer([2, 3])
int_30 = Integer(dijkstra_shortest_path_4.VerticesIndexes)
pt_251 = Point([Point(2323.49617, 80.4593659, 0), Point(1849.16511, 29.17453745, 0), Point(1374.815203, -21.93552527, 0), Point(900.4013915, -72.44822345, 0), Point(425.7653036, -120.8144557, 0), Point(-48.92718211, -139.3718171, 0)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])
int_31 = Integer([1, 8])
pt_252 = Point([Point(-2373.037494, 76.59373595, 0), Point(-7086.253482, -878.5005001, 0)])
crv_22 = Curve(dijkstra_shortest_path_6.Edges)
assert_point_list_58 = AssertPointList(
    TestName="DijkstraShortestPathMilimeters_Vornoi_Edges",
    ExpectedPointList=pt_242,
    ActualPointList=divide_21.Points,
    Tolerance="0.0001")  # -> Result, FailedInfo
pt_253 = Point([Point(2323.49617, 80.4593659, 0), Point(-2373.037494, 76.59373595, 0), Point(-7086.253482, -878.5005001, 0)])
assert_point_list_59 = AssertPointList(
    TestName="DijkstraShortestPathMilimeters_Vornoi_Vertices",
    ExpectedPointList=pt_243,
    ActualPointList=dijkstra_shortest_path_3.Vertices,
    Tolerance="0.0001")  # -> Result, FailedInfo
assert_point_list_60 = AssertPointList(
    TestName="DijkstraShortestPathMilimeters_TriangleWithEdge_Edges",
    ExpectedPointList=pt_244,
    ActualPointList=divide_22.Points,
    Tolerance="0.0001")  # -> Result, FailedInfo
assert_point_list_61 = AssertPointList(
    TestName="DijkstraShortestPathMilimeters_Sphere_Edges",
    ExpectedPointList=pt_246,
    ActualPointList=divide_23.Points,
    Tolerance="0.0001")  # -> Result, FailedInfo
assert_point_list_62 = AssertPointList(
    TestName="DijkstraShortestPathMilimeters_TriangleWithEdge_Vertices",
    ExpectedPointList=pt_247,
    ActualPointList=dijkstra_shortest_path_2.Vertices,
    Tolerance="0.0001")  # -> Result, FailedInfo
int_32 = Integer([1, 2])
assert_point_list_63 = AssertPointList(
    TestName="DijkstraShortestPathMilimeters_Sphere_Vertices",
    ExpectedPointList=pt_248,
    ActualPointList=dijkstra_shortest_path_4.Vertices,
    Tolerance="0.0001")  # -> Result, FailedInfo
assert_point_list_64 = AssertPointList(
    TestName="DijkstraShortestPathMilimeters_Vornoi_VisitedVertices",
    ExpectedPointList=pt_245,
    ActualPointList=dijkstra_shortest_path_3.VisitedVertices,
    Tolerance="0.0001")  # -> Result, FailedInfo
assert_list_50 = AssertList(
    TestName="DijkstraShortestPathMilimeters_Vornoi_EdgesIndexes",
    ExpectedList=int_25,
    ActualList=dijkstra_shortest_path_3.EdgesIndexes)  # -> Result, FailedInfo
assert_list_51 = AssertList(
    TestName="DijkstraShortestPathMilimeters_Vornoi_VerticesIndexes",
    ExpectedList=int_28,
    ActualList=dijkstra_shortest_path_3.VerticesIndexes)  # -> Result, FailedInfo
assert_point_list_65 = AssertPointList(
    TestName=panel_71,
    ExpectedPointList=pt_249,
    ActualPointList=dijkstra_shortest_path_2.VisitedVertices,
    Tolerance="0.0001")  # -> Result, FailedInfo
assert_point_list_66 = AssertPointList(
    TestName="DijkstraShortestPathMilimeters_Sphere_VisitedVertices",
    ExpectedPointList=pt_250,
    ActualPointList=dijkstra_shortest_path_4.VisitedVertices,
    Tolerance="0.0001")  # -> Result, FailedInfo
assert_list_52 = AssertList(TestName=panel_70, ExpectedList=int_26, ActualList=dijkstra_shortest_path_2.EdgesIndexes)  # -> Result, FailedInfo
crv_23 = Curve(dijkstra_shortest_path_3.Edges)
assert_list_53 = AssertList(
    TestName="DijkstraShortestPathMilimeters_Sphere_EdgesIndexes",
    ExpectedList=int_27,
    ActualList=dijkstra_shortest_path_4.EdgesIndexes)  # -> Result, FailedInfo
int_33 = Integer([2650, 2970, 3328, 3686, 3692, 4032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])
assert_list_54 = AssertList(TestName=panel_72, ExpectedList=int_29, ActualList=dijkstra_shortest_path_2.VerticesIndexes)  # -> Result, FailedInfo
assert_list_55 = AssertList(
    TestName="DijkstraShortestPathMilimeters_Sphere_VerticesIndexes",
    ExpectedList=int_30,
    ActualList=dijkstra_shortest_path_4.VerticesIndexes)  # -> Result, FailedInfo
pt_254 = Point([Point(-789.7933872, -1304.434969, 0), Point(-787.3192932, -1304.434969, 0), Point(-784.8451992, -1304.434969, 0), Point(-782.3711052, -1304.434969, 0), Point(-779.8970113, -1304.434969, 0), Point(-777.4229173, -1304.434969, 0)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])
crv_24 = Curve(dijkstra_shortest_path_4.Edges)
pt_255 = Point([Point(-765.0524474, -1304.434969, 0), Point(-740.3115076, -1304.434969, 0), Point(-715.5705678, -1304.434969, 0), Point(-715.5705678, -1285.470395, 0), Point(-690.8296281, -1285.470395, 0), Point(-690.8296281, -1266.505821, 0)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])
pt_256 = Point([Point(-789.7933872, -1304.434969, 0), Point(-789.7933872, -1285.470395, 0), Point(-789.7933872, -1323.399543, 0), Point(-814.5343269, -1304.434969, 0), Point(-765.0524474, -1304.434969, 0), Point(-789.7933872, -1266.505821, 0)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])
assert_point_list_67 = AssertPointList(
    TestName="DijkstraShortestPathMilimeters_ManyEdges_Edges",
    ExpectedPointList=pt_251,
    ActualPointList=divide_24.Points,
    Tolerance="0.0001")  # -> Result, FailedInfo
assert_point_list_68 = AssertPointList(
    TestName="DijkstraShortestPathMilimeters_ManyEdges_Vertices",
    ExpectedPointList=pt_252,
    ActualPointList=dijkstra_shortest_path_5.Vertices,
    Tolerance="0.0001")  # -> Result, FailedInfo
int_34 = Integer([944, 1050, 1162, 1163, 1272, 1273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])
assert_point_list_69 = AssertPointList(
    TestName="DijkstraShortestPathMilimeters_ManyEdges_VisitedVertices",
    ExpectedPointList=pt_253,
    ActualPointList=dijkstra_shortest_path_5.VisitedVertices,
    Tolerance="0.0001")  # -> Result, FailedInfo
assert_list_56 = AssertList(
    TestName="DijkstraShortestPathMilimeters_ManyEdges_EdgesIndexes",
    ExpectedList=int_31,
    ActualList=dijkstra_shortest_path_5.EdgesIndexes)  # -> Result, FailedInfo
assert_list_57 = AssertList(
    TestName="DijkstraShortestPathMilimeters_ManyEdges_VerticesIndexes",
    ExpectedList=int_32,
    ActualList=dijkstra_shortest_path_5.VerticesIndexes)  # -> Result, FailedInfo
crv_25 = Curve(dijkstra_shortest_path_5.Edges)
entwine_33 = Entwine(
    Branch00=assert_point_list_55.Result,
    Branch01=assert_point_list_56.Result,
    Branch02=assert_list_48.Result,
    Branch03=assert_list_49.Result,
    Branch04=assert_point_list_57.Result,
    FlattenInputs=True)  # -> flatten(Result)
assert_point_list_70 = AssertPointList(
    TestName="DijkstraShortestPathMilimeters_MeshWithDeletedFaces_Edges",
    ExpectedPointList=pt_254,
    ActualPointList=divide_25.Points,
    Tolerance="0.0001")  # -> Result, FailedInfo
assert_point_list_71 = AssertPointList(TestName=panel_75, ExpectedPointList=pt_255, ActualPointList=dijkstra_shortest_path_6.Vertices, Tolerance="0.0001")  # -> Result, FailedInfo
assert_point_list_72 = AssertPointList(
    TestName=panel_74,
    ExpectedPointList=pt_256,
    ActualPointList=dijkstra_shortest_path_6.VisitedVertices,
    Tolerance="0.0001")  # -> Result, FailedInfo
assert_list_58 = AssertList(TestName=panel_73, ExpectedList=int_33, ActualList=dijkstra_shortest_path_6.EdgesIndexes)  # -> Result, FailedInfo
assert_list_59 = AssertList(TestName=panel_76, ExpectedList=int_34, ActualList=dijkstra_shortest_path_6.VerticesIndexes)  # -> Result, FailedInfo
entwine_34 = Entwine(
    Branch00=assert_point_list_58.Result,
    Branch01=assert_point_list_59.Result,
    Branch02=assert_list_50.Result,
    Branch03=assert_list_51.Result,
    Branch04=assert_point_list_64.Result,
    FlattenInputs=True)  # -> flatten(Result)
entwine_35 = Entwine(
    Branch00=assert_point_list_60.Result,
    Branch01=assert_point_list_62.Result,
    Branch02=assert_list_52.Result,
    Branch03=assert_list_54.Result,
    Branch04=assert_point_list_65.Result,
    FlattenInputs=True)  # -> flatten(Result)
entwine_36 = Entwine(
    Branch00=assert_point_list_61.Result,
    Branch01=assert_point_list_63.Result,
    Branch02=assert_list_53.Result,
    Branch03=assert_list_55.Result,
    Branch04=assert_point_list_66.Result,
    FlattenInputs=True)  # -> flatten(Result)
entwine_37 = Entwine(
    Branch00=assert_point_list_67.Result,
    Branch01=assert_point_list_68.Result,
    Branch02=assert_list_56.Result,
    Branch03=assert_list_57.Result,
    Branch04=assert_point_list_69.Result,
    FlattenInputs=True)  # -> flatten(Result)
entwine_38 = Entwine(
    Branch00=assert_point_list_70.Result,
    Branch01=assert_point_list_71.Result,
    Branch02=assert_list_58.Result,
    Branch03=assert_list_59.Result,
    Branch04=assert_point_list_72.Result,
    FlattenInputs=True)  # -> flatten(Result)
entwine_39 = Entwine(
    Branch00=entwine_33,
    Branch01=entwine_35,
    Branch02=entwine_38,
    Branch03=entwine_37,
    Branch04=entwine_34,
    Branch05=entwine_36,
    FlattenInputs=True)  # -> flatten(Result)

pt_257 = ConstructPoint(XCoordinate=0, YCoordinate=0, ZCoordinate=0)
pt_258 = ConstructPoint(XCoordinate=Slider(10, range=0..10), YCoordinate=0, ZCoordinate=0)
pt_259 = ConstructPoint(XCoordinate=0, YCoordinate=0, ZCoordinate=0)
pt_260 = ConstructPoint(XCoordinate=Slider(10, range=0..10), YCoordinate=0, ZCoordinate=0)
two_points_to_graph_part_68 = TwoPointsToGraphPart(PointA=pt_257, PointB=pt_258, IsDirected=Toggle(False))
two_points_to_graph_part_69 = TwoPointsToGraphPart(PointA=pt_259, PointB=pt_260, IsDirected=Toggle(True))
create_graph_39 = CreateGraph(GraphParts=two_points_to_graph_part_68, Tolerance=0.0001)
create_graph_40 = CreateGraph(GraphParts=two_points_to_graph_part_69, Tolerance=0.0001)
dijkstra_shortest_path_7 = DijkstraShortestPath(Graph=create_graph_39, StartVertexIndex="1", EndVertexIndex="1")  # -> Edges, Vertices, EdgesIndexes, VerticesIndexes, VisitedVertices
dijkstra_shortest_path_8 = DijkstraShortestPath(Graph=create_graph_40, StartVertexIndex="1", EndVertexIndex="0")  # -> Edges, Vertices, EdgesIndexes, VerticesIndexes, VisitedVertices

# ---- group: Middle Pt
pt_261 = Point(Point(-2373.037494, 76.59373595, 0))

# ---- group: End Pt
pt_262 = Point(Point(-7086.253482, -878.5005001, 0))

# ----
# A* Shortest Path
pt_263 = Point(Point(1857.487169, 667.8807363, 0))
pt_264 = Point(Point(-987.7209054, -1513.045284, 0))
rec_2pt_3 = Rectangle2Pt(Plane=PlaneXY(0, 0, 0), PointA=pt_264, PointB=pt_263, Radius=0)  # -> Rectangle, Length
number_slider_35 = Slider(5, range=0..10)
number_slider_36 = Slider(115, range=0..200)
number_slider_37 = Slider(1000, range=0..1000)
pt_265 = ConstructPoint(XCoordinate=0, YCoordinate=0, ZCoordinate=0)
pt_266 = ConstructPoint(XCoordinate=Slider(10, range=0..10), YCoordinate=0, ZCoordinate=0)
boundary_14 = BoundarySurfaces(Edges=rec_2pt_3.Rectangle)
pt_267 = Point(Point(0, 0, 0))
start_pt_3 = Point(Point(2323.49617, 80.4593659, 0))
Z_2 = UnitZ(Factor=Slider(2000, range=0..2000))
number_slider_38 = Slider(118, range=0..1000)
toggle_17 = BooleanToggle(True)
number_slider_39 = Slider(400, range=0..400)
xy_4 = XYPlane(Origin=pt_267)
pt_268 = ConstructPoint(XCoordinate=number_slider_35, YCoordinate=Slider(10, range=0..20), ZCoordinate=0)
mesh_uv_12 = MeshSurface(Surface=boundary_14, UCount=number_slider_36, VCount=number_slider_36, Overhang=False, Equalize=False)
pt_269 = ConstructPoint(XCoordinate=Slider(10, range=0..10), YCoordinate=0, ZCoordinate=0)
pt_270 = ConstructPoint(XCoordinate=0, YCoordinate=0, ZCoordinate=0)
pt_271 = ConstructPoint(XCoordinate=0, YCoordinate=0, ZCoordinate=0)
pt_272 = ConstructPoint(XCoordinate=number_slider_35, YCoordinate=Slider(5, range=0..10), ZCoordinate=0)
two_points_to_graph_part_70 = TwoPointsToGraphPart(PointA=pt_265, PointB=pt_266, IsDirected=Toggle(True))
move_6 = Move(Geometry=pt_267, Motion=Z_2)  # -> Geometry, Transform
xy_5 = XYPlane(Origin=Point(0, 0, 0))
pt_273 = Point([Point(95.16766784, -160.5831548, 0), Point(-100.6916859, -181.1556044, 0), Point(-145.7169725, 73.58864204, 0), Point(-312.513996, -114.255042, 0)])
pt_274 = Point([Point(6.529616711, -43.36252302, 0), Point(323.1289101, 156.6400322, 0), Point(185.7341702, 434.1291855, 0), Point(-177.5993761, 528.7290912, 0), Point(-288.0345346, 110.2040014, 0)])
pt_275 = Point([Point(249.5053044, -642.6485607, 0), Point(212.9099763, -99.81786157, 0), Point(-180.0994911, -309.7410809, 0), Point(-98.15031194, -118.1155256, 0), Point(-336.0199442, -26.6272055, 0), Point(-512.897363, -32.72642684, 0), Point(-403.2141018, 85.13636504, 0)])
pt_276 = Point(start_pt_3)
pt_277 = Point([Point(-2346.920815, -265.5973513, 0), Point(-2495.659637, -823.3679355, 0), Point(-2040.146993, -981.4029344, 0), Point(-1408.006998, -432.9285265, 0), Point(-1640.411408, -228.4126457, 0), Point(-952.4943539, -386.4476445, 0), Point(-571.3511214, -1018.58764, 0), Point(-831.6440607, -1334.657638, 0)])
pt_278 = Point([Point(1075.006962, -187.2068887, 0), Point(753.8829581, -29.11507164, 0), Point(235.1441832, 529.1466575, 0), Point(-491.0901016, 519.2659189, 0), Point(-990.0673993, 237.6648697, 0), Point(-1543.388759, -24.17470235, 0)])
pt_279 = Point([Point(239.6437385, -410.7149406, 0), Point(101.5251699, -665.7030671, 0), Point(-194.1902268, -817.9876427, 0), Point(-475.7396165, -679.8690742, 0), Point(-613.858185, -408.9441897, 0), Point(-608.5459324, -299.1576353, 0)])
pt_280 = Point([Point(2602.527565, 7.372193304, 0), Point(2534.758439, -263.7043106, 0), Point(2120.613781, -158.2856702, 0), Point(2120.613781, -7.687612471, 0)])
pt_281 = Point([Point(-2017.961267, -308.3723872, 0), Point(-948.9009801, -912.6238534, 0), Point(-1218.490096, -1210.101498, 0), Point(-1153.416861, -1990.980316, 0)])
pt_282 = Point([Point(-2681.583165, 571.0585251, 0), Point(-3313.723161, 1184.606168, 0), Point(-3936.56698, 1110.236757, 0), Point(-4522.226093, 422.3197026, 0), Point(-4838.296091, -33.19294117, 0)])
pt_283 = Point([Point(-3293.638829, 485.2123529, 0), Point(-4395.407884, 726.2243337, 0), Point(-5244.688198, 645.8870068, 0), Point(-6059.538228, 129.4327621, 0), Point(-7253.121371, 347.491221, 0)])
box_2 = CenterBox(Base=xy_4, X=number_slider_37, Y=number_slider_37, Z=number_slider_37)
two_points_to_graph_part_71 = TwoPointsToGraphPart(PointA=pt_272, PointB=pt_268, IsDirected=toggle_17)
demesh_3 = DeconstructMesh(Mesh=mesh_uv_12)  # -> Vertices, Faces, Colours, Normals
two_points_to_graph_part_72 = TwoPointsToGraphPart(PointA=pt_271, PointB=pt_272, IsDirected=toggle_17)
two_points_to_graph_part_73 = TwoPointsToGraphPart(PointA=pt_269, PointB=pt_272, IsDirected=toggle_17)
two_points_to_graph_part_74 = TwoPointsToGraphPart(PointA=pt_270, PointB=pt_269, IsDirected=toggle_17)
nurbs_31 = NurbsCurve(Vertices=[start_pt_3, pt_275, pt_261], Degree=3, Periodic=False)  # -> Curve, Length, Domain
nurbs_32 = NurbsCurve(Vertices=[start_pt_3, pt_278, pt_261], Degree=3, Periodic=False)  # -> Curve, Length, Domain
nurbs_33 = NurbsCurve(Vertices=[start_pt_3, pt_279, pt_261], Degree=3, Periodic=False)  # -> Curve, Length, Domain
nurbs_34 = NurbsCurve(Vertices=[start_pt_3, pt_273, pt_261], Degree=3, Periodic=False)  # -> Curve, Length, Domain
nurbs_35 = NurbsCurve(Vertices=[start_pt_3, pt_274, pt_261], Degree=3, Periodic=False)  # -> Curve, Length, Domain
nurbs_36 = NurbsCurve(Vertices=[pt_261, pt_277, pt_262], Degree=3, Periodic=False)  # -> Curve, Length, Domain
nurbs_37 = NurbsCurve(Vertices=[pt_261, pt_281, pt_262], Degree=3, Periodic=False)  # -> Curve, Length, Domain
nurbs_38 = NurbsCurve(Vertices=[pt_261, pt_282, pt_262], Degree=3, Periodic=False)  # -> Curve, Length, Domain
nurbs_39 = NurbsCurve(Vertices=[start_pt_3, pt_280, pt_276], Degree=3, Periodic=False)  # -> Curve, Length, Domain
nurbs_40 = NurbsCurve(Vertices=[pt_261, pt_283, pt_262], Degree=3, Periodic=False)  # -> Curve, Length, Domain
msphere_4 = MeshSphere(Base=xy_5, Radius=Slider(18226, range=0..51000), UCount=number_slider_38, VCount=number_slider_38)
pop3d_2 = Populate3D(Region=box_2, Count=number_slider_39, Seed=1)
create_graph_41 = CreateGraph(GraphParts=two_points_to_graph_part_70, Tolerance=0.0001)
pt_284 = Point(Point(16772.5661, -7570.092391, 2.728484105e-12))
pt_285 = Point(Point(-11059.8348, -11991.24039, 0))
panel_77 = Panel("AStarShortestPathMilimeters_1GraphEdgeDirectedStart0_EdgesIndexes")
panel_78 = Panel("AStarShortestPathMilimeters_1GraphEdgeDirectedStart0_VisitedVertices")
panel_79 = Panel("AStarShortestPathMilimeters_1GraphEdgeDirectedStart0_Vertices")
panel_80 = Panel("AStarShortestPathMilimeters_1GraphEdgeDirectedStart0_VerticesIndexes")
mesh_to_graph_20 = MeshToGraph(Mesh=msphere_4)
lng_5 = ListLength(List=demesh_3.Faces)
voronoi³_2 = Voronoi3D(Points=pop3d_2)  # -> Cells, Boundary
curve_to_graph_part_11 = CurveToGraphPart(
    Curve=[nurbs_35.Curve, nurbs_34.Curve, nurbs_31.Curve, nurbs_32.Curve, nurbs_33.Curve, nurbs_39.Curve, nurbs_37.Curve, nurbs_36.Curve, nurbs_38.Curve, nurbs_40.Curve],
    IsDirected=True)
random_4 = Random(Range=lng_5, Number=Slider(9664, range=0..11000), Seed=2)
get_closest_vertex_index_5 = GetClosestVertexIndex(Graph=mesh_to_graph_20, Point=[pt_285, pt_284])
create_graph_42 = CreateGraph(
    GraphParts=[two_points_to_graph_part_74, two_points_to_graph_part_72, two_points_to_graph_part_73, two_points_to_graph_part_71],
    Tolerance=0.0001)
dom_2 = ConstructDomain(DomainStart=0, DomainEnd=number_slider_39)
debrep_2 = DeconstructBrep(Brep=voronoi³_2.Cells)  # -> Faces, Edges, Vertices
a_shortest_path = AShortestPath(Graph=create_graph_41, StartVertexIndex="0", EndVertexIndex="1")  # -> Edges, Vertices, EdgesIndexes, VerticesIndexes, VisitedVertices
int_35 = Integer(random_4)
curve_to_graph_part_12 = CurveToGraphPart(Curve=debrep_2.Edges, IsDirected=False)  # -> flatten(GraphPart)
panel_81 = Panel("AStarShortestPathMilimeters_TriangleWithEdge_VisitedVertices")
panel_82 = Panel("AStarShortestPathMilimeters_TriangleWithEdge_VerticesIndexes")
random_5 = Random(Range=dom_2, Number=2, Seed=Slider(53, range=0..110), Integers=True)
deletef_3 = DeleteFaces(Mesh=mesh_uv_12, Indices=int_35)
create_graph_43 = CreateGraph(GraphParts=curve_to_graph_part_11, Tolerance=0.0001)
item_12 = ListItem(List=get_closest_vertex_index_5, Index=0, Wrap=True)  # -> Item, Item1
crv_26 = Curve(debrep_2.Edges)
pt_286 = Point(Point(-799.7722196, -1310.349308, 0))
pt_287 = Point(Point(1380.439883, 186.2902823, 0))
item_13 = ListItem(List=random_5, Index=0, Wrap=True)  # -> Item, Item1
panel_83 = Panel("AStarShortestPathMilimeters_MeshWithDeletedFaces_EdgesIndexes")
a_shortest_path_2 = AShortestPath(Graph=create_graph_42, StartVertexIndex="0", EndVertexIndex="3")  # -> Edges, Vertices, EdgesIndexes, VerticesIndexes, VisitedVertices
panel_84 = Panel("AStarShortestPathMilimeters_MeshWithDeletedFaces_VisitedVertices")
panel_85 = Panel("AStarShortestPathMilimeters_MeshWithDeletedFaces_VerticesIndexes")
divide_26 = DivideCurve(Curve=a_shortest_path.Edges, Count=10, Kinks=False)  # -> Points, Tangents, Parameters
mesh_3 = Mesh(deletef_3)
create_graph_44 = CreateGraph(GraphParts=curve_to_graph_part_12, Tolerance=0.0001)
a_shortest_path_3 = AShortestPath(Graph=mesh_to_graph_20, StartVertexIndex=item_12.Item, EndVertexIndex=item_12.Item1)  # -> Edges, Vertices, EdgesIndexes, VerticesIndexes, VisitedVertices
pt_288 = Point([Point(0, 0, 0), Point(1, 0, 0), Point(2, 0, 0), Point(3, 0, 0), Point(4, 0, 0), Point(5, 0, 0), Point(6, 0, 0), Point(7, 0, 0), Point(8, 0, 0), Point(9, 0, 0), Point(10, 0, 0)])
mesh_to_graph_21 = MeshToGraph(Mesh=mesh_3)
get_closest_vertex_index_6 = GetClosestVertexIndex(Graph=mesh_to_graph_21, Point=[pt_286, pt_287])
pt_289 = Point(Point(10, 0, 0))
int_36 = Integer(0)
a_shortest_path_4 = AShortestPath(Graph=create_graph_44, StartVertexIndex=item_13.Item, EndVertexIndex=item_13.Item1)  # -> Edges, Vertices, EdgesIndexes, VerticesIndexes, VisitedVertices
pt_290 = Point([Point(0, 0, 0), Point(10, 0, 0)])
int_37 = Integer(1)
a_shortest_path_5 = AShortestPath(Graph=create_graph_43, StartVertexIndex="0", EndVertexIndex="2")  # -> Edges, Vertices, EdgesIndexes, VerticesIndexes, VisitedVertices
preview_3 = CustomPreview(Geometry=crv_26, Material=ColourSwatch(SwatchColor=RGB(105, 227, 255)))
divide_27 = DivideCurve(Curve=a_shortest_path_4.Edges, Count=10, Kinks=False)  # -> flatten(Points), Tangents, Parameters
assert_point_list_73 = AssertPointList(
    TestName="AStarShortestPathMilimeters_1GraphEdgeDirectedStart0_Edges",
    ExpectedPointList=pt_288,
    ActualPointList=divide_26.Points,
    Tolerance="0.0001")  # -> Result, FailedInfo
assert_point_list_74 = AssertPointList(TestName=panel_79, ExpectedPointList=pt_289, ActualPointList=a_shortest_path.Vertices, Tolerance="0.0001")  # -> Result, FailedInfo
divide_28 = DivideCurve(Curve=a_shortest_path_2.Edges, Count=10, Kinks=False)  # -> flatten(Points), Tangents, Parameters
divide_29 = DivideCurve(Curve=a_shortest_path_3.Edges, Count=10, Kinks=False)  # -> flatten(Points), Tangents, Parameters
assert_point_list_75 = AssertPointList(TestName=panel_78, ExpectedPointList=pt_290, ActualPointList=a_shortest_path.VisitedVertices, Tolerance="0.0001")  # -> Result, FailedInfo
assert_list_60 = AssertList(TestName=panel_77, ExpectedList=int_36, ActualList=a_shortest_path.EdgesIndexes)  # -> Result, FailedInfo
assert_list_61 = AssertList(TestName=panel_80, ExpectedList=int_37, ActualList=a_shortest_path.VerticesIndexes)  # -> Result, FailedInfo
divide_30 = DivideCurve(Curve=a_shortest_path_5.Edges, Count=10, Kinks=False)  # -> flatten(Points), Tangents, Parameters
item_14 = ListItem(List=get_closest_vertex_index_6, Index=0, Wrap=True)  # -> Item, Item1
a_shortest_path_6 = AShortestPath(Graph=mesh_to_graph_21, StartVertexIndex=item_14.Item, EndVertexIndex=item_14.Item1)  # -> Edges, Vertices, EdgesIndexes, VerticesIndexes, VisitedVertices
pt_291 = Point([Point(-280.0025859, 337.3169172, 963.3168942), Point(-279.7861888, 330.2955051, 940.3064447), Point(-279.5697917, 323.274093, 917.2959952), Point(-279.3533946, 316.2526809, 894.2855457), Point(-279.1369975, 309.2312688, 871.2750962), Point(-278.9206005, 302.2098567, 848.2646467)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])
pt_292 = Point([Point(-277.838615, 267.1027963, 733.2123992), Point(-75.80244862, 162.0977605, 652.2820899), Point(-85.26860437, 135.1740462, 650.1466686), Point(-117.4324927, 51.95421602, 636.6293679), Point(-46.63892985, -73.33844735, 581.2467293), Point(59.31378687, -112.0571232, 539.426991)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])
int_38 = Integer([479, 466, 17371, 14512, 8620, 17316, 24074, 1777, 1804, 1766, 8891, 15304, 4139, 18330, 4115, 16516, 18329, 5832, 12217, 12215, 12250])
pt_293 = Point([Point(0, 0, 0), Point(0.5, 0.5, 0), Point(1, 1, 0), Point(1.5, 1.5, 0), Point(2, 2, 0), Point(2.5, 2.5, 0), Point(3, 3, 0), Point(3.5, 3.5, 0), Point(4, 4, 0), Point(4.5, 4.5, 0), Point(5, 5, 0), Point(5, 5, 0), Point(5, 5.5, 0), Point(5, 6, 0), Point(5, 6.5, 0), Point(5, 7, 0), Point(5, 7.5, 0), Point(5, 8, 0), Point(5, 8.5, 0), Point(5, 9, 0), Point(5, 9.5, 0), Point(5, 10, 0)])
pt_294 = Point([Point(-280.0025859, 337.3169172, 963.3168942), Point(-277.838615, 267.1027963, 733.2123992), Point(-255.1498736, 338.1382464, 998.9444464), Point(-75.80244862, 162.0977605, 652.2820899), Point(-300.5473238, 329.1491108, 998.9444464), Point(-73.347394, 161.6185494, 653.9423109)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])
pt_295 = Point([Point(-12002.02839, -13716.35485, 0), Point(-11927.32592, -13778.28823, 0), Point(-11852.62344, -13840.22161, 0), Point(-11777.92097, -13902.15499, 0), Point(-11703.21849, -13964.08837, 0), Point(-11628.51601, -14026.02175, 0)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])
pt_296 = Point([Point(5, 5, 0), Point(5, 10, 0)])
int_39 = Integer([1, 3])
pt_297 = Point([Point(-11255.00363, -14335.68866, 0), Point(-10476.07534, -14914.38639, 0), Point(-9667.451471, -15450.80768, 0), Point(-8831.424163, -15943.43198, 0), Point(-7970.363223, -16390.86288, 0), Point(-7086.709422, -16791.83211, 0)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])
int_40 = Integer([27914, 27918, 27922, 27926, 27930, 27934, 27938, 27942, 27946, 27950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])
pt_298 = Point([Point(-12002.02839, -13716.35485, 0), Point(-11255.00363, -14335.68866, 0), Point(-11997.77501, -13711.49393, -485.1856237), Point(-11997.77501, -13711.49393, 485.1856237), Point(-10476.07534, -14914.38639, 0), Point(-11251.01498, -14330.60825, 485.1856237)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])
pt_299 = Point([Point(0, 0, 0), Point(5, 5, 0), Point(5, 10, 0)])
int_41 = Integer([159, 160, 164, 2025, 2026, 2024, 593, 598, 592, 591, 2054, 1321, 1316, 1318, 1319, 1677, 1676, 1685, 2098, 2101, 147])
int_42 = Integer([2, 3])
int_43 = Integer([6921, 6922, 6923, 6924, 6925, 6926, 6927, 6928, 6929, 6930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])
pt_300 = Point([Point(2323.49617, 80.4593659, 0), Point(1849.16511, 29.17453745, 0), Point(1374.815203, -21.93552527, 0), Point(900.4013915, -72.44822345, 0), Point(425.7653036, -120.8144557, 0), Point(-48.92718211, -139.3718171, 0)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])
int_44 = Integer([1, 8])
pt_301 = Point([Point(-2373.037494, 76.59373595, 0), Point(-7086.253482, -878.5005001, 0)])
crv_27 = Curve(a_shortest_path_6.Edges)
divide_31 = DivideCurve(Curve=crv_27, Count=10, Kinks=False)  # -> flatten(Points), Tangents, Parameters
assert_point_list_76 = AssertPointList(
    TestName="AStarShortestPathMilimeters_Vornoi_Edges",
    ExpectedPointList=pt_291,
    ActualPointList=divide_27.Points,
    Tolerance="0.0001")  # -> Result, FailedInfo
assert_point_list_77 = AssertPointList(
    TestName="AStarShortestPathMilimeters_Vornoi_Vertices",
    ExpectedPointList=pt_292,
    ActualPointList=a_shortest_path_4.Vertices,
    Tolerance="0.0001")  # -> Result, FailedInfo
pt_302 = Point([Point(2323.49617, 80.4593659, 0), Point(-2373.037494, 76.59373595, 0), Point(-7086.253482, -878.5005001, 0)])
assert_point_list_78 = AssertPointList(
    TestName="AStarShortestPathMilimeters_TriangleWithEdge_Edges",
    ExpectedPointList=pt_293,
    ActualPointList=divide_28.Points,
    Tolerance="0.0001")  # -> Result, FailedInfo
assert_point_list_79 = AssertPointList(
    TestName="AStarShortestPathMilimeters_Sphere_Edges",
    ExpectedPointList=pt_295,
    ActualPointList=divide_29.Points,
    Tolerance="0.0001")  # -> Result, FailedInfo
assert_point_list_80 = AssertPointList(
    TestName="AStarShortestPathMilimeters_TriangleWithEdge_Vertices",
    ExpectedPointList=pt_296,
    ActualPointList=a_shortest_path_2.Vertices,
    Tolerance="0.0001")  # -> Result, FailedInfo
assert_point_list_81 = AssertPointList(
    TestName="AStarShortestPathMilimeters_Sphere_Vertices",
    ExpectedPointList=pt_297,
    ActualPointList=a_shortest_path_3.Vertices,
    Tolerance="0.0001")  # -> Result, FailedInfo
int_45 = Integer([1, 2])
assert_point_list_82 = AssertPointList(
    TestName="AStarShortestPathMilimeters_Vornoi_VisitedVertices",
    ExpectedPointList=pt_294,
    ActualPointList=a_shortest_path_4.VisitedVertices,
    Tolerance="0.0001")  # -> Result, FailedInfo
assert_list_62 = AssertList(
    TestName="AStarShortestPathMilimeters_Vornoi_EdgesIndexes",
    ExpectedList=int_38,
    ActualList=a_shortest_path_4.EdgesIndexes)  # -> Result, FailedInfo
crv_28 = Curve(a_shortest_path_3.Edges)
assert_list_63 = AssertList(
    TestName="AStarShortestPathMilimeters_Vornoi_VerticesIndexes",
    ExpectedList=int_41,
    ActualList=a_shortest_path_4.VerticesIndexes)  # -> Result, FailedInfo
assert_point_list_83 = AssertPointList(TestName=panel_81, ExpectedPointList=pt_299, ActualPointList=a_shortest_path_2.VisitedVertices, Tolerance="0.0001")  # -> Result, FailedInfo
assert_point_list_84 = AssertPointList(
    TestName="AStarShortestPathMilimeters_Sphere_VisitedVertices",
    ExpectedPointList=pt_298,
    ActualPointList=a_shortest_path_3.VisitedVertices,
    Tolerance="0.0001")  # -> Result, FailedInfo
assert_list_64 = AssertList(
    TestName="AStarShortestPathMilimeters_TriangleWithEdge_EdgesIndexes",
    ExpectedList=int_39,
    ActualList=a_shortest_path_2.EdgesIndexes)  # -> Result, FailedInfo
crv_29 = Curve(a_shortest_path_4.Edges)
assert_list_65 = AssertList(
    TestName="AStarShortestPathMilimeters_Sphere_EdgesIndexes",
    ExpectedList=int_40,
    ActualList=a_shortest_path_3.EdgesIndexes)  # -> Result, FailedInfo
int_46 = Integer([2650, 2970, 3328, 3686, 3692, 4032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])
assert_list_66 = AssertList(TestName=panel_82, ExpectedList=int_42, ActualList=a_shortest_path_2.VerticesIndexes)  # -> Result, FailedInfo
assert_list_67 = AssertList(
    TestName="AStarShortestPathMilimeters_Sphere_VerticesIndexes",
    ExpectedList=int_43,
    ActualList=a_shortest_path_3.VerticesIndexes)  # -> Result, FailedInfo
pt_303 = Point([Point(-789.7933872, -1304.434969, 0), Point(-787.3192932, -1304.434969, 0), Point(-784.8451992, -1304.434969, 0), Point(-782.3711052, -1304.434969, 0), Point(-779.8970113, -1304.434969, 0), Point(-777.4229173, -1304.434969, 0)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])
pt_304 = Point([Point(-765.0524474, -1304.434969, 0), Point(-740.3115076, -1304.434969, 0), Point(-715.5705678, -1304.434969, 0), Point(-715.5705678, -1285.470395, 0), Point(-690.8296281, -1285.470395, 0), Point(-690.8296281, -1266.505821, 0)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])
pt_305 = Point([Point(-789.7933872, -1304.434969, 0), Point(-765.0524474, -1304.434969, 0), Point(-789.7933872, -1285.470395, 0), Point(-740.3115076, -1304.434969, 0), Point(-715.5705678, -1304.434969, 0), Point(-789.7933872, -1266.505821, 0)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])
assert_point_list_85 = AssertPointList(
    TestName="AStarShortestPathMilimeters_ManyEdges_Edges",
    ExpectedPointList=pt_300,
    ActualPointList=divide_30.Points,
    Tolerance="0.0001")  # -> Result, FailedInfo
assert_point_list_86 = AssertPointList(
    TestName="AStarShortestPathMilimeters_ManyEdges_Vertices",
    ExpectedPointList=pt_301,
    ActualPointList=a_shortest_path_5.Vertices,
    Tolerance="0.0001")  # -> Result, FailedInfo
int_47 = Integer([944, 1050, 1162, 1163, 1272, 1273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])
assert_point_list_87 = AssertPointList(
    TestName="AStarShortestPathMilimeters_ManyEdges_VisitedVertices",
    ExpectedPointList=pt_302,
    ActualPointList=a_shortest_path_5.VisitedVertices,
    Tolerance="0.0001")  # -> Result, FailedInfo
assert_list_68 = AssertList(
    TestName="AStarShortestPathMilimeters_ManyEdges_EdgesIndexes",
    ExpectedList=int_44,
    ActualList=a_shortest_path_5.EdgesIndexes)  # -> Result, FailedInfo
assert_list_69 = AssertList(
    TestName="AStarShortestPathMilimeters_ManyEdges_VerticesIndexes",
    ExpectedList=int_45,
    ActualList=a_shortest_path_5.VerticesIndexes)  # -> Result, FailedInfo
crv_30 = Curve(a_shortest_path_5.Edges)
entwine_40 = Entwine(
    Branch00=assert_point_list_73.Result,
    Branch01=assert_point_list_74.Result,
    Branch02=assert_list_60.Result,
    Branch03=assert_list_61.Result,
    Branch04=assert_point_list_75.Result,
    FlattenInputs=True)  # -> flatten(Result)
assert_point_list_88 = AssertPointList(
    TestName="AStarShortestPathMilimeters_MeshWithDeletedFaces_Edges",
    ExpectedPointList=pt_303,
    ActualPointList=divide_31.Points,
    Tolerance="0.0001")  # -> Result, FailedInfo
assert_point_list_89 = AssertPointList(
    TestName="AStarShortestPathMilimeters_MeshWithDeletedFaces_Vertices",
    ExpectedPointList=pt_304,
    ActualPointList=a_shortest_path_6.Vertices,
    Tolerance="0.0001")  # -> Result, FailedInfo
assert_point_list_90 = AssertPointList(TestName=panel_84, ExpectedPointList=pt_305, ActualPointList=a_shortest_path_6.VisitedVertices, Tolerance="0.0001")  # -> Result, FailedInfo
assert_list_70 = AssertList(TestName=panel_83, ExpectedList=int_46, ActualList=a_shortest_path_6.EdgesIndexes)  # -> Result, FailedInfo
assert_list_71 = AssertList(TestName=panel_85, ExpectedList=int_47, ActualList=a_shortest_path_6.VerticesIndexes)  # -> Result, FailedInfo
entwine_41 = Entwine(
    Branch00=assert_point_list_76.Result,
    Branch01=assert_point_list_77.Result,
    Branch02=assert_list_62.Result,
    Branch03=assert_list_63.Result,
    Branch04=assert_point_list_82.Result,
    FlattenInputs=True)  # -> flatten(Result)
entwine_42 = Entwine(
    Branch00=assert_point_list_78.Result,
    Branch01=assert_point_list_80.Result,
    Branch02=assert_list_64.Result,
    Branch03=assert_list_66.Result,
    Branch04=assert_point_list_83.Result,
    FlattenInputs=True)  # -> flatten(Result)
entwine_43 = Entwine(
    Branch00=assert_point_list_79.Result,
    Branch01=assert_point_list_81.Result,
    Branch02=assert_list_65.Result,
    Branch03=assert_list_67.Result,
    Branch04=assert_point_list_84.Result,
    FlattenInputs=True)  # -> flatten(Result)
entwine_44 = Entwine(
    Branch00=assert_point_list_85.Result,
    Branch01=assert_point_list_86.Result,
    Branch02=assert_list_68.Result,
    Branch03=assert_list_69.Result,
    Branch04=assert_point_list_87.Result,
    FlattenInputs=True)  # -> flatten(Result)
entwine_45 = Entwine(
    Branch00=assert_point_list_88.Result,
    Branch01=assert_point_list_89.Result,
    Branch02=assert_list_70.Result,
    Branch03=assert_list_71.Result,
    Branch04=assert_point_list_90.Result,
    FlattenInputs=True)  # -> flatten(Result)
entwine_46 = Entwine(
    Branch00=entwine_40,
    Branch01=entwine_42,
    Branch02=entwine_45,
    Branch03=entwine_44,
    Branch04=entwine_41,
    Branch05=entwine_43,
    FlattenInputs=True)  # -> flatten(Result)

# ----
# Result:
total = Total(Results=flatten([entwine_3, entwine_2, entwine, entwine_9, entwine_14, entwine_15, entwine_16, entwine_17, entwine_18, entwine_19, entwine_20, entwine_25, entwine_32, entwine_39, entwine_46]))  # -> TotalResult, ReportPart
panel_86 = Panel(total.TotalResult)

# ----
# Export report:
# Table of contents:
# Curve To Graph Part
# Two Points To Graph Part
# Vector To Graph Part
# Create Graph
# Mesh To Graph
# Graph To Report Part
# Get Closest Vertex
create_report = CreateReport(ReportParts=[calendar, total.ReportPart], TableOfContents=False)
path = FilePath("C:\Users\code-structures\Desktop\Projekty\2020_12_03_Megarachne\Megarachne\Megarachne\Megarachne\TestsInsideGrasshopper\Report.md")  # disabled
# Unit Tests inside Grasshopper
# 
# Required plugins:
# - Megarachne
# - Pterodactyl
# - Brontosaurus
save_report = SaveReport(Report=create_report, Path=path)  # disabled

pt_306 = ConstructPoint(XCoordinate=0, YCoordinate=0, ZCoordinate=0)
pt_307 = ConstructPoint(XCoordinate=Slider(10, range=0..10), YCoordinate=0, ZCoordinate=0)
pt_308 = ConstructPoint(XCoordinate=0, YCoordinate=0, ZCoordinate=0)
pt_309 = ConstructPoint(XCoordinate=Slider(10, range=0..10), YCoordinate=0, ZCoordinate=0)
two_points_to_graph_part_75 = TwoPointsToGraphPart(PointA=pt_306, PointB=pt_307, IsDirected=Toggle(False))
two_points_to_graph_part_76 = TwoPointsToGraphPart(PointA=pt_308, PointB=pt_309, IsDirected=Toggle(True))
create_graph_45 = CreateGraph(GraphParts=two_points_to_graph_part_75, Tolerance=0.0001)
create_graph_46 = CreateGraph(GraphParts=two_points_to_graph_part_76, Tolerance=0.0001)
a_shortest_path_7 = AShortestPath(Graph=create_graph_45, StartVertexIndex="1", EndVertexIndex="1")  # -> Edges, Vertices, EdgesIndexes, VerticesIndexes, VisitedVertices
a_shortest_path_8 = AShortestPath(Graph=create_graph_46, StartVertexIndex="1", EndVertexIndex="0")  # -> Edges, Vertices, EdgesIndexes, VerticesIndexes, VisitedVertices
